vi "synchronize.gvi"   [LabVIEW NXG]
inputs:
  "Modulation Parameters In": T7 = {"Modulation Type"="QPSK", "Control Information\nfor Packet Header/Tail"={"Training Sequence (derived)"=[], "Zero Pad Length"=0}, "RX Oversample Factor"=20, "Synchronization Options"={"Synchronization Method"="Timing Estimation", "Fixed Offset"=0, "Symbol Timing Recovery Method"="Max Energy", "Frame Detection Method"="Sliding Correlator", "Frequency Estimation Method"="", "Correct Frequency Offset"=FALSE, "Correct Symbol Timing"=FALSE}, "Number of Data Symbols (Derived)"=100, "RX Sample Rate"=4000000, "Pulse Shaping Parameters"={"Modulation Type"="PSK", "Pulse Shaping Filter"="Root Raised Cos", "Filter Parameter"=0.5, "Filter Length (Symbols)"=8}, "Channel Estimation/Equalization Parameters"={"Equalization Method"="Direct", "Channel Estimate Length"=1, "Equalizer Length"=1, "Equalizer Delay"=-1, "Equalize"=FALSE}}
  "Input Complex Waveform": cluster{"t0": f64, "dt": f64, "Y": c128[]}
  "TX Channel Model Parameters": T1 = {"Noise Power (dB)"=-Inf, "Channel Response"=[], "Frequency Offset"=0, "Delay (sec)"=0, "Channel Model"="AWGN"}
  "error in (no error)": error
outputs:
  "Modulation Parameters Out": T7
  "Output Complex Symbols": c128[]
  "Offset": i32
  "error out": error
  "Intermediate Complex Waveform": cluster{"t0": f64, "dt": f64, "Y": c128[]}
  "Channel Estimate": c128[]
  "Estimated Frequency Offset": f64
types:
  T1 = cluster{"Noise Power (dB)": f64, "Channel Response": c128[], "Frequency Offset": f64, "Delay (sec)": f64, "Channel Model": string}
  T2 = cluster{"Training Sequence (derived)": c128[], "Zero Pad Length": i32}
  T3 = cluster{"Synchronization Method": string, "Fixed Offset": i32, "Symbol Timing Recovery Method": string, "Frame Detection Method": string, "Frequency Estimation Method": string, "Correct Frequency Offset": bool, "Correct Symbol Timing": bool}
  T4 = enum{"none", "Raised Cosine", "Root Raised Cos", "Gaussian"}
  T5 = cluster{"Modulation Type": enum{"FSK", "PSK", "QAM", "MSK", "PAM", "ASK"}, "Pulse Shaping Filter": T4, "Filter Parameter": f64, "Filter Length (Symbols)": i32}
  T6 = cluster{"Equalization Method": string, "Channel Estimate Length": i32, "Equalizer Length": i32, "Equalizer Delay": i32, "Equalize": bool}
  T7 = cluster{"Modulation Type": string, "Control Information\nfor Packet Header/Tail": T2, "RX Oversample Factor": i32, "Synchronization Options": T3, "Number of Data Symbols (Derived)": i32, "RX Sample Rate": f64, "Pulse Shaping Parameters": T5, "Channel Estimation/Equalization Parameters": T6}
diagram:
  $"Modulation Parameters Out" <- $"Modulation Parameters In"
  case ($"error in (no error)") {
    frame No Error {
      # Recover symbol timing, perform frame detection, and estimate frequency offset correction
      Property Node(instance in=$"Modulation Parameters In") -> ("Synchronization Options:Synchronization Method"=w2, "Synchronization Options:Correct Symbol Timing"=w3)
      case (w2) {
        frame "Timing Estimation" {
          call "symbol_timing.gvi"(Modulation Parameters In=$"Modulation Parameters In", Input Complex Waveform=$"Input Complex Waveform", TX Channel Model Parameters=$"TX Channel Model Parameters", error in (no error)=$"error in (no error)") -> (Modulation Parameters Out=w8, Output Complex Waveform=w9, Alignment Offset=w10, error out=w11)
          Property Node(instance in=$"Modulation Parameters In") -> ("RX Oversample Factor"=w12)
          call "frame_detect.gvi"(Modulation Parameters In=w8, Input Complex Waveform=w9, TX Channel Model Parameters=$"TX Channel Model Parameters", error in (no error)=w11, Alignment Offset=w10) -> (Output=w4, Frame Offset=w13, Frequency Offset=w7, error out=w1)
          Multiply(w13, w12) -> w14
          Add(w10, w14) -> w15
          To Long Integer(number=w15) -> w5
          w6 = c128[] []
        }
        frame "Fixed Offset", Default {
          call "symbol_timing.gvi"(Modulation Parameters In=$"Modulation Parameters In", Input Complex Waveform=$"Input Complex Waveform", error in (no error)=$"error in (no error)") -> (Output Complex Waveform=w16, Alignment Offset=w17, error out=w1)
          Property Node(instance in=w16) -> ("Y"=w4)
          To Long Integer(number=w17) -> w5
          w6 = c128[] []
          w7 = 0
        }
        frame "Joint Timing and Channel Estimation" {
          call "joint_estimation.gvi"(Modulation Parameters In=$"Modulation Parameters In", Input Complex Waveform=$"Input Complex Waveform", error in (no error)=$"error in (no error)") -> (Recovered Complex Symbols=w4, Frequency Offset=w7, Total Offset=w5, error out=w1, Channel Estimate=w6)
        }
      }
      case (w3) {
        frame False, Default {
          w18 = 0
        }
        frame True {
          w18 = w5
        }
      }
      Property Node(instance in=$"Input Complex Waveform") -> ("Y"=w19)
      Delete From Array(inArray=w19, length (1)=w18, index0=0) -> w20
      Property Node(instance in=$"Input Complex Waveform", "t0"=0, "Y"=w20) -> (instance out=w21)
      # Get intermediate waveform for eye diagram graph
      $"Intermediate Complex Waveform" <- w21
      $"Output Complex Symbols" <- w4
      $"Estimated Frequency Offset" <- w7
      $Offset <- w5
      $"Channel Estimate" <- w6
    }
    frame Error {
      w1 = $"error in (no error)"
    }
  }
  $"error out" <- w1
