vi "symbol_timing.gvi"   [LabVIEW NXG]
inputs:
  "Modulation Parameters In": T7 = {"Modulation Type"="QPSK", "Control Information\nfor Packet Header/Tail"={"Training Sequence (derived)"=[], "Zero Pad Length"=0}, "RX Oversample Factor"=20, "Synchronization Options"={"Synchronization Method"="Timing Estimation", "Fixed Offset"=0, "Symbol Timing Recovery Method"="Max Energy", "Frame Detection Method"="Sliding Correlator", "Frequency Estimation Method"="", "Correct Frequency Offset"=FALSE, "Correct Symbol Timing"=FALSE}, "Number of Data Symbols (Derived)"=100, "RX Sample Rate"=4000000, "Pulse Shaping Parameters"={"Modulation Type"="PSK", "Pulse Shaping Filter"="Root Raised Cos", "Filter Parameter"=0.5, "Filter Length (Symbols)"=8}, "Channel Estimation/Equalization Parameters"={"Equalization Method"="Direct", "Channel Estimate Length"=1, "Equalizer Length"=1, "Equalizer Delay"=-1, "Equalize"=FALSE}}
  "Input Complex Waveform": cluster{"t0": f64, "dt": f64, "Y": c128[]} = {"t0"=0, "dt"=1, "Y"=[]}
  "TX Channel Model Parameters": T1 = {"Noise Power (dB)"=-Inf, "Channel Response"=[], "Frequency Offset"=0, "Delay (sec)"=0, "Channel Model"="AWGN"}
  "error in (no error)": error
outputs:
  "Modulation Parameters Out": T7
  "Output Complex Waveform": cluster{"t0": f64, "dt": f64, "Y": c128[]}
  "Alignment Offset": f64
  "error out": error
types:
  T1 = cluster{"Noise Power (dB)": f64, "Channel Response": c128[], "Frequency Offset": f64, "Delay (sec)": f64, "Channel Model": string}
  T2 = cluster{"Training Sequence (derived)": c128[], "Zero Pad Length": i32}
  T3 = cluster{"Synchronization Method": string, "Fixed Offset": i32, "Symbol Timing Recovery Method": string, "Frame Detection Method": string, "Frequency Estimation Method": string, "Correct Frequency Offset": bool, "Correct Symbol Timing": bool}
  T4 = enum{"none", "Raised Cosine", "Root Raised Cos", "Gaussian"}
  T5 = cluster{"Modulation Type": enum{"FSK", "PSK", "QAM", "MSK", "PAM", "ASK"}, "Pulse Shaping Filter": T4, "Filter Parameter": f64, "Filter Length (Symbols)": i32}
  T6 = cluster{"Equalization Method": string, "Channel Estimate Length": i32, "Equalizer Length": i32, "Equalizer Delay": i32, "Equalize": bool}
  T7 = cluster{"Modulation Type": string, "Control Information\nfor Packet Header/Tail": T2, "RX Oversample Factor": i32, "Synchronization Options": T3, "Number of Data Symbols (Derived)": i32, "RX Sample Rate": f64, "Pulse Shaping Parameters": T5, "Channel Estimation/Equalization Parameters": T6}
diagram:
  case ($"error in (no error)") {
    frame No Error {
      Property Node(instance in=$"Modulation Parameters In") -> (instance out=w3, "Synchronization Options:Symbol Timing Recovery Method"=w4, "Synchronization Options:Fixed Offset"=w5, "RX Oversample Factor"=w6, "Pulse Shaping Parameters"=w7, "Synchronization Options:Correct Symbol Timing"=w8)
      # Use appropriate timing recovery method
      case (w4) {
        frame "MT Align to Ideal Symbols", Default {
          Property Node(instance in=w7) -> ("Modulation Type"=w11, "Pulse Shaping Filter"=w12, "Filter Parameter"=w13, "Filter Length (Symbols)"=w14)
          call "MT Generate Filter Coefficients.gvi"(pulse shaping filter=w12, pulse shaping samples per symbol=w6, matched samples per symbol=w6, filter parameter=w13, error in=$"error in (no error)", modulation type=w11, filter length=w14) -> (matched filter coefficients=w15, error out=w16)
          call "MT Align to Ideal Symbols (Generic).gvi"(input complex waveform=$"Input Complex Waveform", matched filter coefficients=w15, samples per symbol=w6, error in=w16) -> (output complex waveform=w9, waveform alignment offset=w10, error out=w1)
          w2 = w3
        }
        frame "Ideal alignment" {
          call "Ideal symbol alignment.gvi"(Modulation Parameters In=w3, Input Complex Waveform=$"Input Complex Waveform", TX Channel Model Parameters=$"TX Channel Model Parameters") -> (Aligned Complex Waveform=w9, Alignment Offset=w10)
          w1 = $"error in (no error)"
          w2 = w3
        }
        frame "Max Energy" {
          call "align_MaxEnergy.gviprotected"(Modulation Parameters In=w3, Input Complex Waveform=$"Input Complex Waveform")
          call "student_align_max_energy.gvi"(Input Complex Waveform=$"Input Complex Waveform", Modulation Parameters In=w3) -> (Aligned Complex Waveform=w9, Modulation Parameters Out=w2, Alignment Offset (Samples)=w10)
          w1 = $"error in (no error)"
        }
        frame "Early-Late Gate" {
          call "align_ELgate.gvi"(Modulation Parameters In=w3, Input Complex Waveform=$"Input Complex Waveform") -> (Modulation Parameters Out=w2, Aligned Complex Waveform=w9, Alignment Offset (Samples)=w10)
          w1 = $"error in (no error)"
        }
        frame "Gardner" {
          call "align_Gardner.gvi"(Modulation Parameters In=w3, Input Complex Waveform=$"Input Complex Waveform", error in (no error)=$"error in (no error)") -> (Alignment Offset (Samples)=w10, Aligned Complex Waveform=w9, Modulation Parameters Out=w2, error out=w1)
        }
        frame "Fixed Offset" {
          Property Node(instance in=$"Input Complex Waveform") -> ("Y"=w17)
          Delete From Array(inArray=w17, length (1)=w5, index0=0) -> w18
          Property Node(instance in=$"Input Complex Waveform", "Y"=w18, "t0"=0) -> (instance out=w9)
          w1 = $"error in (no error)"
          w2 = w3
          w10 = w5
        }
        frame "Early late gate custom" {
          call "align_ELgate_2.gvi"(Modulation Parameters In=w3, Input Complex Waveform=$"Input Complex Waveform") -> (Modulation Parameters Out=w2, Aligned Complex Waveform=w9, Alignment Offset (Samples)=w10)
          w1 = $"error in (no error)"
        }
      }
      case (w8) {
        frame False, Default {
          w19 = $"Input Complex Waveform"
        }
        frame True {
          w19 = w9
        }
      }
      Property Node(instance in=w19) -> ("Y"=w20)
      call "Decimate (single shot, CDB).gvi"(x=w20, decimating factor=w6) -> (decimated array=w21)
      # Downsample corrected signal
      Property Node(instance in=w19, "Y"=w21) -> (instance out=w22)
      $"Output Complex Waveform" <- w22
      $"Alignment Offset" <- w10
    }
    frame Error {
      w1 = $"error in (no error)"
      w2 = $"Modulation Parameters In"
    }
  }
  $"Modulation Parameters Out" <- w2
  $"error out" <- w1
