vi "receiver.gvi"   [LabVIEW NXG]
inputs:
  "HW Parameters In": T3 = {"Active Antenna"="RX1", "Carrier Frequency (Hz)"=915000000, "Gain (dB)"=10, "Trigger Level"=0.01, "Bandwidth (Hz)"=40000000, "Reference Position (%)"=10, "Capture Time (s)"=0.002, "Simulate"=FALSE, "Device IP Address"="192.168.10.2"}
  "Modulation Parameters In": T11 = {"Modulation Type"="QPSK", "Control Information\nfor Packet Header/Tail"={"Training Sequence (derived)"=[], "Zero Pad Length"=0}, "RX Oversample Factor"=20, "Synchronization Options"={"Synchronization Method"="Timing Estimation", "Fixed Offset"=0, "Symbol Timing Recovery Method"="Max Energy", "Frame Detection Method"="Sliding Correlator", "Frequency Estimation Method"="", "Correct Frequency Offset"=FALSE, "Correct Symbol Timing"=FALSE}, "Number of Data Symbols (Derived)"=100, "RX Sample Rate"=4000000, "Pulse Shaping Parameters"={"Modulation Type"="PSK", "Pulse Shaping Filter"="Root Raised Cos", "Filter Parameter"=0.5, "Filter Length (Symbols)"=8}, "Channel Estimation/Equalization Parameters"={"Equalization Method"="Direct", "Channel Estimate Length"=1, "Equalizer Length"=1, "Equalizer Delay"=-1, "Equalize"=FALSE}}
  "Queues In": T2
  "error in (no error)": error
  "Input Complex Waveform": cluster{"t0": f64, "dt": f64, "Y": c128[]}
  "TX Channel Model Parameters": T5 = {"Noise Power (dB)"=-Inf, "Channel Response"=[], "Frequency Offset"=0, "Delay (sec)"=0, "Channel Model"="AWGN"}
outputs:
  "error out": error
  "Modulation Parameters Out": T11
  "HW Parameters Out": T3
  "Queues Out": T2
  "RX waveforms out": T4
  "Overhead Offset": i32
  "Symbol Rate": f64
  "Bit-Error Rate": f64
  "Offset": i32
  "Key Bit Sequence": i8[]
  "Measured channel impairements": T1
types:
  T1 = cluster{"SNR(dB)": f64, "Channel Estimate": c128[], "Frequency Offset": f64, "Delay": f64}
  T2 = cluster{"Element 1": Queue<u8[]>, "Element 2": Queue<c128[]>}
  T3 = cluster{"Active Antenna": string, "Carrier Frequency (Hz)": f64, "Gain (dB)": f64, "Trigger Level": f64, "Bandwidth (Hz)": f64, "Reference Position (%)": f64, "Capture Time (s)": f64, "Simulate": bool, "Device IP Address": string}
  T4 = cluster{"Eye Diagram": cluster{"t0": f64, "dt": f64, "Y": f64[]}[], "Power Delay Profile": DoubleAnalogWaveform, "IQ Graph": cluster{"Element 1": f64[], "Element 2": f64[]}[]}
  T5 = cluster{"Noise Power (dB)": f64, "Channel Response": c128[], "Frequency Offset": f64, "Delay (sec)": f64, "Channel Model": string}
  T6 = cluster{"Training Sequence (derived)": c128[], "Zero Pad Length": i32}
  T7 = cluster{"Synchronization Method": string, "Fixed Offset": i32, "Symbol Timing Recovery Method": string, "Frame Detection Method": string, "Frequency Estimation Method": string, "Correct Frequency Offset": bool, "Correct Symbol Timing": bool}
  T8 = enum{"none", "Raised Cosine", "Root Raised Cos", "Gaussian"}
  T9 = cluster{"Modulation Type": enum{"FSK", "PSK", "QAM", "MSK", "PAM", "ASK"}, "Pulse Shaping Filter": T8, "Filter Parameter": f64, "Filter Length (Symbols)": i32}
  T10 = cluster{"Equalization Method": string, "Channel Estimate Length": i32, "Equalizer Length": i32, "Equalizer Delay": i32, "Equalize": bool}
  T11 = cluster{"Modulation Type": string, "Control Information\nfor Packet Header/Tail": T6, "RX Oversample Factor": i32, "Synchronization Options": T7, "Number of Data Symbols (Derived)": i32, "RX Sample Rate": f64, "Pulse Shaping Parameters": T9, "Channel Estimation/Equalization Parameters": T10}
diagram:
  $"HW Parameters Out" <- $"HW Parameters In"
  case ($"error in (no error)") {
    frame No Error {
      call "receiver_init (SubVI).gvi"(Modulation Parameters In=$"Modulation Parameters In", Queues In=$"Queues In") -> (Modulation Parameters Out=w4, Queues Out=w3, symbol rate=w5, key bit sequence=w6, overhead offset=w7)
      call "matched_filtering.gviprotected"(Modulation Parameters In=w4, Input Complex Waveform=$"Input Complex Waveform", error in (no error)=$"error in (no error)") -> (Modulation Parameters Out=w8, Output Complex Waveform=w9, error out=w10)
      call "synchronize.gvi"(Modulation Parameters In=w8, Input Complex Waveform=w9, TX Channel Model Parameters=$"TX Channel Model Parameters", error in (no error)=w10) -> (Modulation Parameters Out=w11, Output Complex Symbols=w12, Offset=w13, error out=w14, Intermediate Complex Waveform=w15, Estimated Frequency Offset=w16)
      call "channel_estimate.gvi"(Modulation Parameters In=w11, Input Symbol Sequence=w12, error in (no error)=w14) -> (Modulation Parameters Out=w17, Channel Estimate=w18, error out=w19)
      call "equalizer.gvi"(Modulation Parameters In=w17, Input=w12, Channel Estimate=w18, error in (no error)=w19) -> (Modulation Parameters Out=w20, Equalized Output=w21, Mean-Squared Error=w22, error out=w23)
      # 1.Determine the number of data symbols and get the key bit sequence and training sequence from the queue
      # 2. Process baseband signal
      # 3. Plot the symbol constellation and eye diagram for recovered symbols
      # 1.Determine the number of data symbols, the symbol rate, the overhead
      # offset, and get the key bit sequence and training sequence from the queue
      Property Node(instance in=w11) -> ("Channel Estimation/Equalization Parameters:Equalize"=w24)
      # 2. Process baseband signal
      case (w24) {
        frame False, Default {
          w25 = w12
        }
        frame True {
          w25 = w21
        }
      }
      call "strip_control.gvi"(Modulation Parameters In=w20, input=w25, error in (no error)=w23) -> (Modulation Parameters Out=w26, data symbols=w27, error out=w28)
      call "receiver_channel_impairments (SubVI).gvi"(Modulation Parameters In=w4, mean-squared error=w22, channel estimate=w18, offset=w13, estimated frequency offset=w16, overhead offset=w7) -> (Measured channel impairements=w29)
      call "decode.gviprotected"(Modulation Parameters In=w26, input symbols=w27, error in (no error)=w28) -> (Modulation Parameters Out=w30, decoded bit stream=w31, error out=w32)
      # 3. Plot the symbol constellation and eye diagram for recovered symbols
      # recovered symbols
      call "receiver_generate_waveforms (SubVI).gvi"(Modulation Parameters In=w30, Intermediate Complex Waveform=w15, Data Symbols=w27, Measured Channel Impairements=w29) -> (Modulation Parameters Out=w2, RX Waveforms Out=w33)
      $"RX waveforms out" <- w33
      $"Symbol Rate" <- w5
      $"Measured channel impairements" <- w29
      # key bit sequence
      $Offset <- w13
      call "error_detect.gvi"(input bit sequence=w31, key bit sequence=w6, error in (no error)=w32) -> (bit-error rate=w34, error out=w1)
      $"Bit-Error Rate" <- w34
      $"Key Bit Sequence" <- w6
      $"Overhead Offset" <- w7
    }
    frame Error {
      w1 = $"error in (no error)"
      w2 = $"Modulation Parameters In"
      w3 = $"Queues In"
    }
  }
  $"Modulation Parameters Out" <- w2
  $"error out" <- w1
  $"Queues Out" <- w3
