vi "simulator_alpha_loop.gvi"   [LabVIEW NXG]
panel controls:
  "# of Iterations": i32 = 1000
  "Control Information for Packet Header/Tail": T1 = {"Training Sequence Type"="Length 11 Barker Sequence", "Zero Pad Length"=8}
  "Packet Length (Bits)": i32 = 500
  "RX Oversample Factor": i32 = 20
  "RX Sample Rate": f64 = 4000000
  "TX Sample Rate": f64 = 4000000
  "TX Oversample Factor": i32 = 20
  "RX HW Parameters": T2 = {"Active Antenna"="RX1", "Carrier Frequency (Hz)"=915000000, "Gain (dB)"=10, "Trigger Level"=0.01, "Bandwidth (Hz)"=915000000, "Reference Position (%)"=10, "Capture Time (s)"=0.0033, "Simulate"=FALSE, "Device IP Address"="192.168.11.2"}
  "TX HW Parameters": T3 = {"Active Antenna"="TX1", "Carrier Frequency (Hz)"=915000000, "Gain (dB)"=10, "Generation Mode"="Simulate", "Device IP Address"="192.168.11.3"}
  "Modulation Type": string = "QPSK"
  "RX Modulation Parameters": T9 = {"Modulation Type"="QPSK", "Control Information\nfor Packet Header/Tail"={"Training Sequence (derived)"=[], "Zero Pad Length"=0}, "RX Oversample Factor"=20, "Synchronization Options"={"Synchronization Method"="Timing Estimation", "Fixed Offset"=0, "Symbol Timing Recovery Method"="Max Energy", "Frame Detection Method"="Sliding Correlator", "Frequency Estimation Method"="", "Correct Frequency Offset"=FALSE, "Correct Symbol Timing"=FALSE}, "Number of Data Symbols (Derived)"=100, "RX Sample Rate"=4000000, "Pulse Shaping Parameters"={"Modulation Type"="PSK", "Pulse Shaping Filter"="Root Raised Cos", "Filter Parameter"=0.5, "Filter Length (Symbols)"=8}, "Channel Estimation/Equalization Parameters"={"Equalization Method"="Direct", "Channel Estimate Length"=1, "Equalizer Length"=1, "Equalizer Delay"=-1, "Equalize"=FALSE}}
  "Channel Estimation/Equalization Parameters": T8 = {"Equalization Method"="Direct", "Channel Estimate Length"=1, "Equalizer Length"=1, "Equalizer Delay"=-1, "Equalize"=FALSE}
  "TX Modulation Parameters": T11 = {"Modulation Type"="QPSK", "Pulse Shaping Parameters"={"Modulation Type"="PSK", "Pulse Shaping Filter"="Root Raised Cos", "Filter Parameter"=0.5, "Filter Length (Symbols)"=8}, "TX Oversample Factor"=20, "Packet Length (Bits)"=500, "TX Sample Rate"=100, "Control Information For Packet Header/Tail"={"Training Sequence "="Length 11 Barker Sequence", "Zero Pad Length"=8}}
  "Synchronization Options": T5 = {"Synchronization Method"="Timing Estimation", "Fixed Offset"=0, "Symbol Timing Recovery Method"="Max Energy", "Frame Detection Method"="Ideal alignment", "Frequency Estimation Method"="Ideal ", "Correct Frequency Offset"=FALSE, "Correct Symbol Timing"=TRUE}
  "Plots": i32
  "alpha values": T13 = {"First value"=0, "Last value"=1, "Step"=0.1}
  "TX Channel Model Parameters": T15 = {"Noise Power (dB)"=-5, "Channel Response"=[], "Frequency Offset"=0, "Delay (sec)"=1.75e-06, "Channel Model"="AWGN"}
  "Pulse Shaping Parameters": T17 = {"Modulation Type"="QAM", "Pulse Shaping Filter"="Root Raised Cos", "Filter Length (Symbols)"=64}
panel indicators:
  "error out": error
  "Received Constellation": cluster{"Element 1": f64[], "Element 2": f64[]}[]
  "Received Eye Diagram": cluster{"t0": f64, "dt": f64, "Y": f64[]}[]
  "Power Delay Profile": waveform<f64>
  "Q Data": waveform<f64>
  "I Data": waveform<f64>
  "Measured Channel Impairements": T12
  "Timing vs alpha": cluster{"Element 1": f64[], "Element 2": f64[]}
  "Progress": f64
  "Output metrics": T14
  "Timing statistics": f64[]
types:
  T1 = cluster{"Training Sequence Type": string, "Zero Pad Length": i32}
  T2 = cluster{"Active Antenna": string, "Carrier Frequency (Hz)": f64, "Gain (dB)": f64, "Trigger Level": f64, "Bandwidth (Hz)": f64, "Reference Position (%)": f64, "Capture Time (s)": f64, "Simulate": bool, "Device IP Address": string}
  T3 = cluster{"Active Antenna": string, "Carrier Frequency (Hz)": f64, "Gain (dB)": f64, "Generation Mode": enum{"Single Shot", "Simulate", "Continuous"}, "Device IP Address": string}
  T4 = cluster{"Training Sequence (derived)": c128[], "Zero Pad Length": i32}
  T5 = cluster{"Synchronization Method": string, "Fixed Offset": i32, "Symbol Timing Recovery Method": string, "Frame Detection Method": string, "Frequency Estimation Method": string, "Correct Frequency Offset": bool, "Correct Symbol Timing": bool}
  T6 = enum{"none", "Raised Cosine", "Root Raised Cos", "Gaussian"}
  T7 = cluster{"Modulation Type": enum{"FSK", "PSK", "QAM", "MSK", "PAM", "ASK"}, "Pulse Shaping Filter": T6, "Filter Parameter": f64, "Filter Length (Symbols)": i32}
  T8 = cluster{"Equalization Method": string, "Channel Estimate Length": i32, "Equalizer Length": i32, "Equalizer Delay": i32, "Equalize": bool}
  T9 = cluster{"Modulation Type": string, "Control Information\nfor Packet Header/Tail": T4, "RX Oversample Factor": i32, "Synchronization Options": T5, "Number of Data Symbols (Derived)": i32, "RX Sample Rate": f64, "Pulse Shaping Parameters": T7, "Channel Estimation/Equalization Parameters": T8}
  T10 = cluster{"Training Sequence ": string, "Zero Pad Length": i32}
  T11 = cluster{"Modulation Type": string, "Pulse Shaping Parameters": T7, "TX Oversample Factor": i32, "Packet Length (Bits)": i32, "TX Sample Rate": f64, "Control Information For Packet Header/Tail": T10}
  T12 = cluster{"SNR(dB)": f64, "Channel Estimate": c128[], "Freq. Offset": f64, "Delay": f64}
  T13 = cluster{"First value": f64, "Last value": f64, "Step": f64}
  T14 = cluster{"Average Bit Error Rate": f64, "Timing Error Statistic": f64, "Frequency Error Statistic": f64}
  T15 = cluster{"Noise Power (dB)": f64, "Channel Response": c128[], "Frequency Offset": f64, "Delay (sec)": f64, "Channel Model": string}
  T16 = enum{"Rectangle", "Raised Cosine", "Root Raised Cos"}
  T17 = cluster{"Modulation Type": enum{"FSK", "PSK", "QAM", "MSK", "PAM", "ASK"}, "Pulse Shaping Filter": T16, "Filter Length (Symbols)": i32}
  T18 = cluster{"Modulation Type": enum{"FSK", "PSK", "QAM", "MSK", "PAM", "ASK"}, "Pulse Shaping Filter": T16, "Filter Parameter": f64, "Filter Length (Symbols)": i32}
diagram:
  Property Node(instance in=$"alpha values") -> ("First value"=w1, "Step"=w2, "Last value"=w3)
  while (iteration -> i1) {
    Multiply(w2, i1) -> w6
    Add(w1, w6) -> w7
    Property Node(instance in=$"Pulse Shaping Parameters") -> ("Modulation Type"=w8, "Pulse Shaping Filter"=w9, "Filter Length (Symbols)"=w10)
    w11 = T18 {"Modulation Type"="QAM", "Pulse Shaping Filter"="Root Raised Cos", "Filter Parameter"=0.5, "Filter Length (Symbols)"=64}
    Property Node(instance in=w11, "Modulation Type"=w8, "Pulse Shaping Filter"=w9, "Filter Length (Symbols)"=w10, "Filter Parameter"=w7) -> (instance out=w12)
    call "simulator.gvi"(# of Iterations=$"# of Iterations", Control Information for Packet Header/Tail=$"Control Information for Packet Header/Tail", Pulse Shaping Parameters=w12, Packet Length (Bits)=$"Packet Length (Bits)", RX Oversample Factor=$"RX Oversample Factor", RX Sample Rate=$"RX Sample Rate", TX Sample Rate=$"TX Sample Rate", TX Oversample Factor=$"TX Oversample Factor", RX HW Parameters=$"RX HW Parameters", TX HW Parameters=$"TX HW Parameters", Modulation Type=$"Modulation Type", RX Modulation Parameters=$"RX Modulation Parameters", Channel Estimation/Equalization Parameters=$"Channel Estimation/Equalization Parameters", TX Modulation Parameters=$"TX Modulation Parameters", Synchronization Options=$"Synchronization Options", Plots=$Plots, TX Channel Model Parameters=$"TX Channel Model Parameters") -> (error out=w13, Received Constellation=w14, Received Eye Diagram=w15, Power Delay Profile=w16, Measured Channel Impairements=w17, I Data=w18, Q Data=w19, Output metrics=w20)
    $"Measured Channel Impairements" <- w17
    $"I Data" <- w18
    $"Q Data" <- w19
    $"Received Eye Diagram" <- w15
    $"Received Constellation" <- w14
    $"error out" <- w13
    Is Greater Or Equal(x=w7, y=w3) -> w21
    $"Power Delay Profile" <- w16
    Property Node(instance in=w20) -> ("Timing Error Statistic"=w22)
    $"Output metrics" <- w20
    Subtract(x=w1, y=w3) -> w23
    Absolute Value(x=w23) -> w24
    Divide(x=w6, y=w24) -> w25
    $Progress <- w25
    append w22 to w4
    append w7 to w5
    stop if w21
  }
  Build Cluster(w5, w4) -> w26
  $"Timing vs alpha" <- w26
  $"Timing statistics" <- w4
