vi "student_align_max_energy.gvi"   [LabVIEW NXG]
inputs:
  "Input Complex Waveform": cluster{"t0": f64, "dt": f64, "Y": c128[]} = {"t0"=0, "dt"=1, "Y"=[]}
  "Modulation Parameters In": T6 = {"Modulation Type"="QPSK", "Control Information\nfor Packet Header/Tail"={"Training Sequence (derived)"=[], "Zero Pad Length"=0}, "RX Oversample Factor"=20, "Synchronization Options"={"Synchronization Method"="Timing Estimation", "Fixed Offset"=0, "Symbol Timing Recovery Method"="Max Energy", "Frame Detection Method"="Sliding Correlator", "Frequency Estimation Method"="", "Correct Frequency Offset"=FALSE, "Correct Symbol Timing"=FALSE}, "Number of Data Symbols (Derived)"=100, "RX Sample Rate"=4000000, "Pulse Shaping Parameters"={"Modulation Type"="PSK", "Pulse Shaping Filter"="Root Raised Cos", "Filter Parameter"=0.5, "Filter Length (Symbols)"=8}, "Channel Estimation/Equalization Parameters"={"Equalization Method"="Direct", "Channel Estimate Length"=1, "Equalizer Length"=1, "Equalizer Delay"=-1, "Equalize"=FALSE}}
  "Error In": error
outputs:
  "Aligned Complex Waveform": cluster{"t0": f64, "dt": f64, "Y": c128[]}
  "Modulation Parameters Out": T6
  "Alignment Offset (Samples)": i32
  "Error Out": error
types:
  T1 = cluster{"Training Sequence (derived)": c128[], "Zero Pad Length": i32}
  T2 = cluster{"Synchronization Method": string, "Fixed Offset": i32, "Symbol Timing Recovery Method": string, "Frame Detection Method": string, "Frequency Estimation Method": string, "Correct Frequency Offset": bool, "Correct Symbol Timing": bool}
  T3 = enum{"none", "Raised Cosine", "Root Raised Cos", "Gaussian"}
  T4 = cluster{"Modulation Type": enum{"FSK", "PSK", "QAM", "MSK", "PAM", "ASK"}, "Pulse Shaping Filter": T3, "Filter Parameter": f64, "Filter Length (Symbols)": i32}
  T5 = cluster{"Equalization Method": string, "Channel Estimate Length": i32, "Equalizer Length": i32, "Equalizer Delay": i32, "Equalize": bool}
  T6 = cluster{"Modulation Type": string, "Control Information\nfor Packet Header/Tail": T1, "RX Oversample Factor": i32, "Synchronization Options": T2, "Number of Data Symbols (Derived)": i32, "RX Sample Rate": f64, "Pulse Shaping Parameters": T4, "Channel Estimation/Equalization Parameters": T5}
diagram:
  $"Modulation Parameters Out" <- $"Modulation Parameters In"
  # TO COMPLETE
  # Useful blocks:
  case ($"Error In") {
    frame No Error, Default {
      Property Node(instance in=$"Input Complex Waveform") -> ("Y"=w4)
      Property Node(instance in=$"Modulation Parameters In") -> ("RX Oversample Factor"=w5)
      Absolute Value(x=w4) -> w6
      Square(x=w6) -> w7
      for (N = w5) (iteration -> i1) {
        Array Subset(array=w7, index0=i1) -> w9
        call "Decimate (single shot, DBL).gvi"(x=w9, decimating factor=w5) -> (decimated array=w10)  # Decimate (single shot).gvi
        Add Array Elements(numeric array=w10) -> (sum=w11)
        append w11 to w8
      }
      Array Max And Min(array=w8) -> (max index(es)=w2)
      Array Subset(array=w4, index0=w2) -> w12
      Property Node(instance in=$"Input Complex Waveform", "Y"=w12) -> (instance out=w3)
      w1 = $"Error In"
    }
    frame Error {
      w1 = $"Error In"
      w2 = 0
      w3 = $"Input Complex Waveform"
    }
  }
  $"Error Out" <- w1
  $"Aligned Complex Waveform" <- w3
  $"Alignment Offset (Samples)" <- w2
