vi "compute_channel_cross_correlation.gvi"   [LabVIEW NXG]
inputs:
  "equalizer delay": i32
  "channel estimate": c128[]
  "Equalizer length": i32
outputs:
  "Formated channel": c128[]
  "Channel cross correlation": c128[]
panel indicators:
  "Graph_2": f64[]
diagram:
  # $"Equalizer length": L
  call "1D Auto Correlation (CDB).gvi"(x=$"channel estimate") -> (rxx=w1)
  Array Size(array=$"channel estimate") -> (size(s)=w2)
  Decrement(x=w2) -> w3
  Array Subset(array=w1, index0=w3, length0=$"Equalizer length") -> w4
  # Compute the autocorrelation of the channel h. Once the correlation have been computed, one has to make sure the output vector is of size L.
  Initialize Array(element=0+0i, size=$"Equalizer length") -> w5
  Replace Array Subset(inArray=w5, 0, w4) -> w6
  $"Channel cross correlation" <- w6
  Complex To Real Imaginary(x + iy=w6) -> (x=w7)
  $Graph_2 <- w7
  # Compute the vector h[-K_2] .... h[K1]
  Initialize Array(element=0+0i, size=$"Equalizer length") -> w8
  Increment(x=$"equalizer delay") -> w9
  Array Subset(array=$"channel estimate", index0=0, length0=w9) -> w10
  Subtract(x=$"Equalizer length", y=w9) -> w11
  Is Less Than 0(x=w11) -> w12
  # In some cases, only part of the channel needs to be taken
  case (w12) {
    frame False, Default {
      w13 = w11
      w14 = w10
    }
    frame True {
      Absolute Value(x=w11) -> w15
      Array Subset(array=w10, index0=w15) -> w14
      w13 = 0
    }
  }
  Replace Array Subset(inArray=w8, w13, w14) -> w16
  $"Formated channel" <- w16
