vi "equalizer.gvi"   [LabVIEW NXG]
inputs:
  "Modulation Parameters In": T6 = {"Modulation Type"="QPSK", "Control Information\nfor Packet Header/Tail"={"Training Sequence (derived)"=[], "Zero Pad Length"=0}, "RX Oversample Factor"=20, "Synchronization Options"={"Synchronization Method"="Timing Estimation", "Fixed Offset"=0, "Symbol Timing Recovery Method"="Max Energy", "Frame Detection Method"="Sliding Correlator", "Frequency Estimation Method"="", "Correct Frequency Offset"=FALSE, "Correct Symbol Timing"=FALSE}, "Number of Data Symbols (Derived)"=100, "RX Sample Rate"=4000000, "Pulse Shaping Parameters"={"Modulation Type"="PSK", "Pulse Shaping Filter"="Root Raised Cos", "Filter Parameter"=0.5, "Filter Length (Symbols)"=8}, "Channel Estimation/Equalization Parameters"={"Equalization Method"="Direct", "Channel Estimate Length"=1, "Equalizer Length"=1, "Equalizer Delay"=-1, "Equalize"=FALSE}}
  "Input": c128[]
  "Channel Estimate": c128[]
  "error in (no error)": error
outputs:
  "Modulation Parameters Out": T6
  "Equalized Output": c128[]
  "Mean-Squared Error": f64
  "error out": error
  "Filter Estimate": c128[]
panel controls:
  "Tab": i32
panel indicators:
  "Error Code": i32
  "Actual Equalizer Delay": i32
  "Channel Estimate (magnitude)": f64[]
  "Channel Estimate (phase)": f64[]
  "x": f64[]
types:
  T1 = cluster{"Training Sequence (derived)": c128[], "Zero Pad Length": i32}
  T2 = cluster{"Synchronization Method": string, "Fixed Offset": i32, "Symbol Timing Recovery Method": string, "Frame Detection Method": string, "Frequency Estimation Method": string, "Correct Frequency Offset": bool, "Correct Symbol Timing": bool}
  T3 = enum{"none", "Raised Cosine", "Root Raised Cos", "Gaussian"}
  T4 = cluster{"Modulation Type": enum{"FSK", "PSK", "QAM", "MSK", "PAM", "ASK"}, "Pulse Shaping Filter": T3, "Filter Parameter": f64, "Filter Length (Symbols)": i32}
  T5 = cluster{"Equalization Method": string, "Channel Estimate Length": i32, "Equalizer Length": i32, "Equalizer Delay": i32, "Equalize": bool}
  T6 = cluster{"Modulation Type": string, "Control Information\nfor Packet Header/Tail": T1, "RX Oversample Factor": i32, "Synchronization Options": T2, "Number of Data Symbols (Derived)": i32, "RX Sample Rate": f64, "Pulse Shaping Parameters": T4, "Channel Estimation/Equalization Parameters": T5}
diagram:
  $"Modulation Parameters Out" <- $"Modulation Parameters In"
  case ($"error in (no error)") {
    frame No Error {
      Complex To Polar(r * e^(i*theta)=$"Channel Estimate") -> (r=w2, theta=w3)
      # 1. Plot magnitude and phase of channel estimate
      $"Channel Estimate (magnitude)" <- w2
      $"Channel Estimate (phase)" <- w3
      Property Node(instance in=$"Modulation Parameters In") -> ("Channel Estimation/Equalization Parameters:Equalization Method"=w4, "Channel Estimation/Equalization Parameters:Channel Estimate Length"=w5, "Channel Estimation/Equalization Parameters:Equalizer Length"=w6, "Channel Estimation/Equalization Parameters:Equalizer Delay"=w7)
      # 1. Plot magnitude and phase of channel estimate
      # 2. Make MMSE estimate of equalizing filter based on channel estimate
      # 3. Apply equalizing filter to input and trim any excess symbols
      # 2. Make MMSE estimate of equalizing filter using appropriate equalization method
      # find filter corresponding
      # to optimal delay
      case (w4) {
        frame "Indirect" {
          call "channel_estimate.gvi"(Modulation Parameters In=$"Modulation Parameters In", Input Symbol Sequence=$Input, error in (no error)=$"error in (no error)") -> (Modulation Parameters Out=w12, Channel Estimate=w13, error out=w14, Mean-Square Error=w11)
          Is Equal(x=w7, y=-1) -> w15
          Decrement(x=w5) -> w16
          Add(w16, w6) -> w17
          Select(s=w15, t=w17, f=1) -> w18
          Select(s=w15, t=0, f=w7) -> w19
          s1 = w14  # shift register
          for (N = w18) (iteration -> i1) {
            Add(w19, i1) -> w21
            call "indirect_equalizer.gvi"(Modulation Parameters In=w12, channel estimate=w13, equalizer delay=w21, error in (no error)=s1) -> (filter estimate=w22, actual equalizer delay=w23, error out=w24, mean-squared error=w25)
            append w25 to w20
            append w22 to w8
            append w23 to w9
            next s1 = w24
          }
          Array Max And Min(array=w20) -> (min index(es)=w10)
          w1 = s1
        }
        frame "Wiener" {
          call "channel_estimate.gvi"(Modulation Parameters In=$"Modulation Parameters In", Input Symbol Sequence=$Input, error in (no error)=$"error in (no error)") -> (Modulation Parameters Out=w26, Channel Estimate=w27, error out=w28, Mean-Square Error=w11)
          Is Equal(x=w7, y=-1) -> w29
          Decrement(x=w5) -> w30
          Add(w30, w6) -> w31
          Select(s=w29, t=w31, f=1) -> w32
          Select(s=w29, t=0, f=w7) -> w33
          Property Node(instance in=$"Modulation Parameters In") -> ("Control Information\nfor Packet Header/Tail:Training Sequence (derived)"=w34, "Channel Estimation/Equalization Parameters:Channel Estimate Length"=w35)
          Array Size(array=w34) -> (size(s)=w36)
          Multiply(w35, 2) -> w37
          Subtract(x=w36, y=w37) -> w38
          Decrement(x=w38) -> w39
          Divide(x=w11, y=w39) -> w40
          s2 = w28  # shift register
          for (N = w32) (iteration -> i2) {
            Property Node(instance in=w26) -> ("Channel Estimation/Equalization Parameters:Equalizer Length"=w42)
            Add(w33, i2) -> w43
            call "student_Wiener_filter.gvi"(equalizer delay=w43, channel estimate=w27, Equalizer length=w42, var_symb=1, var_noise=w40) -> (Wiener filter coeff=w44, MSE=w45)
            append w45 to w41
            append w44 to w8
            append w43 to w9
          }
          Array Max And Min(array=w41) -> (min index(es)=w10)
          w1 = s2
        }
        frame "Direct", Default {
          # if delay=-1, then optimize
          # over possible delay values
          Is Equal(x=w7, y=-1) -> w46
          # choose correct inputs corresponding
          # to equalization method
          Select(s=w46, t=0, f=w7) -> w47
          Select(s=w46, t=w6, f=1) -> w48
          s3 = $"error in (no error)"  # shift register
          for (N = w48) (iteration -> i3) {
            Add(w47, i3) -> w50
            call "direct_equalizer.gvi"(Modulation Parameters In=$"Modulation Parameters In", Input=$Input, Equalizer Delay=w50, error in (no error)=s3) -> (Filter Estimate=w51, Mean-Squared Error=w52, Actual Equalizer Delay=w53, error out=w54)
            append w51 to w8
            append w52 to w49
            append w53 to w9
            next s3 = w54
          }
          Array Max And Min(array=w49) -> (min index(es)=w10, min value=w11)
          w1 = s3
        }
      }
      Array Index(array=w8) -> (out0[w10, _]=w55)
      # 3. Apply equalizing filter to input and trim any excess symbols
      Complex To Real Imaginary(x + iy=w55) -> (x=w56)
      $x <- w56
      $"Mean-Squared Error" <- w11
      $"Filter Estimate" <- w55
      Array Index(array=w9) -> (out0[w10]=w57)
      call "1D Convolution (CDB).gvi"(x=$Input, y=w55) -> (x * y=w58, error=w59)
      Array Subset(array=w58, index0=w57) -> w60
      $"Equalized Output" <- w60
      $"Error Code" <- w59
      $"Actual Equalizer Delay" <- w57
    }
    frame Error {
      w1 = $"error in (no error)"
    }
  }
  $"error out" <- w1
