vi "receiver_generate_waveforms (SubVI).gvi"   [LabVIEW NXG]
inputs:
  "Modulation Parameters In": T9 = {"Modulation Type"="QPSK", "Control Information\nfor Packet Header/Tail"={"Training Sequence (derived)"=[], "Zero Pad Length"=0}, "RX Oversample Factor"=20, "Synchronization Options"={"Synchronization Method"="Timing Estimation", "Fixed Offset"=0, "Symbol Timing Recovery Method"="Max Energy", "Frame Detection Method"="Sliding Correlator", "Frequency Estimation Method"="", "Correct Frequency Offset"=FALSE, "Correct Symbol Timing"=FALSE}, "Number of Data Symbols (Derived)"=100, "RX Sample Rate"=4000000, "Pulse Shaping Parameters"={"Modulation Type"="PSK", "Pulse Shaping Filter"="Root Raised Cos", "Filter Parameter"=0.5, "Filter Length (Symbols)"=8}, "Channel Estimation/Equalization Parameters"={"Equalization Method"="Direct", "Channel Estimate Length"=1, "Equalizer Length"=1, "Equalizer Delay"=-1, "Equalize"=FALSE}}
  "Intermediate Complex Waveform": cluster{"t0": f64, "dt": f64, "Y": c128[]} = {"t0"=0, "dt"=1, "Y"=[]}
  "Data Symbols": c128[]
  "Measured Channel Impairements": T1
outputs:
  "Modulation Parameters Out": T9
  "RX Waveforms Out": T2
panel controls:
  "I/Q (I)": enum{"I", "Q"} = "I"
  "Eye Length": i32 = 2
  "Tab": i32
panel indicators:
  "Power Delay Profile": waveform<f64>
  "Received Constellation": T3[]
  "Eye Diagram": cluster{"t0": f64, "dt": f64, "Y": f64[]}[]
types:
  T1 = cluster{"SNR(dB)": f64, "channel estimate": c128[], "freq. offset": f64, "delay": f64}
  T2 = cluster{"Eye Diagram": cluster{"t0": f64, "dt": f64, "Y": f64[]}[], "Power Delay Profile": DoubleAnalogWaveform, "IQ Graph": cluster{"Element 1": f64[], "Element 2": f64[]}[]}
  T3 = cluster{"constellation": f64[], "oversampled data": f64[]}
  T4 = cluster{"Training Sequence (derived)": c128[], "Zero Pad Length": i32}
  T5 = cluster{"Synchronization Method": string, "Fixed Offset": i32, "Symbol Timing Recovery Method": string, "Frame Detection Method": string, "Frequency Estimation Method": string, "Correct Frequency Offset": bool, "Correct Symbol Timing": bool}
  T6 = enum{"none", "Raised Cosine", "Root Raised Cos", "Gaussian"}
  T7 = cluster{"Modulation Type": enum{"FSK", "PSK", "QAM", "MSK", "PAM", "ASK"}, "Pulse Shaping Filter": T6, "Filter Parameter": f64, "Filter Length (Symbols)": i32}
  T8 = cluster{"Equalization Method": string, "Channel Estimate Length": i32, "Equalizer Length": i32, "Equalizer Delay": i32, "Equalize": bool}
  T9 = cluster{"Modulation Type": string, "Control Information\nfor Packet Header/Tail": T4, "RX Oversample Factor": i32, "Synchronization Options": T5, "Number of Data Symbols (Derived)": i32, "RX Sample Rate": f64, "Pulse Shaping Parameters": T7, "Channel Estimation/Equalization Parameters": T8}
diagram:
  Property Node(instance in=$"Modulation Parameters In") -> ("RX Sample Rate"=w1, "RX Oversample Factor"=w2)
  Divide(x=w1, y=w2) -> w3
  Reciprocal(x=w3) -> w4
  call "make_MTwaveform.gvi"(dt=w4, Y=$"Data Symbols") -> (output MT waveform=w5)
  call "MT Format Constellation.gvi"(waveform=w5) -> (constellation graph=w6)
  $"Received Constellation" <- w6
  $"Modulation Parameters Out" <- $"Modulation Parameters In"
  call "MT Format Eye Diagram (complex).gvi"(waveform=$"Intermediate Complex Waveform", symbol rate=w3, eye length=$"Eye Length", I/Q=$"I/Q (I)") -> (eye diagram=w7)
  Property Node(instance in=$"Measured Channel Impairements") -> ("channel estimate"=w8)
  call "Upsample (CDB).gvi"(x=w8, upsampling factor=w2) -> (upsampled array=w9)
  # w3: symbol rate
  Reciprocal(x=w1) -> w10
  call "make_MTwaveform.gvi"(dt=w10, Y=w9) -> (output MT waveform=w11)
  call "MT Get Complex IQ Component.gvi"(IQ data in=w11, component choice="Magnitude") -> (CE component=w12)
  Property Node(instance in=w12) -> ("Y"=w13, "t0"=w14, "dt"=w15)
  Square(x=w13) -> w16
  Build Waveform Node(Y=w16, dt=w15, t0=w14) -> (output waveform=w17)
  Property Node(instance in=$"RX Waveforms Out", "IQ Graph"=w6, "Eye Diagram"=w7, "Power Delay Profile"=w17) -> (instance out=w18)
  $"RX Waveforms Out" <- w18
  $"Eye Diagram" <- w7
  $"Power Delay Profile" <- w17
