vi "simulator.gvi"   [LabVIEW NXG]
inputs:
  "# of Iterations": i32 = 1
  "Control Information for Packet Header/Tail": T1 = {"Training Sequence Type"="Length 11 Barker Sequence", "Zero Pad Length"=8}
  "Pulse Shaping Parameters": T3 = {"Modulation Type"="QAM", "Pulse Shaping Filter"="Root Raised Cos", "Filter Parameter"=0.5, "Filter Length (Symbols)"=64}
  "Packet Length (Bits)": i32 = 1000
  "RX Oversample Factor": i32 = 20
  "RX Sample Rate": f64 = 4000000
  "TX Sample Rate": f64 = 4000000
  "TX Oversample Factor": i32 = 20
  "RX HW Parameters": T4 = {"Active Antenna"="RX1", "Carrier Frequency (Hz)"=915000000, "Gain (dB)"=10, "Trigger Level"=0.01, "Bandwidth (Hz)"=915000000, "Reference Position (%)"=10, "Capture Time (s)"=0.0033, "Simulate"=FALSE, "Device IP Address"="192.168.11.2"}
  "TX HW Parameters": T5 = {"Active Antenna"="TX1", "Carrier Frequency (Hz)"=915000000, "Gain (dB)"=10, "Generation Mode"="Simulate", "Device IP Address"="192.168.11.3"}
  "Modulation Type": string = "QPSK"
  "RX Modulation Parameters": T11 = {"Modulation Type"="QPSK", "Control Information\nfor Packet Header/Tail"={"Training Sequence (derived)"=[], "Zero Pad Length"=0}, "RX Oversample Factor"=20, "Synchronization Options"={"Synchronization Method"="Timing Estimation", "Fixed Offset"=0, "Symbol Timing Recovery Method"="Max Energy", "Frame Detection Method"="Sliding Correlator", "Frequency Estimation Method"="", "Correct Frequency Offset"=FALSE, "Correct Symbol Timing"=FALSE}, "Number of Data Symbols (Derived)"=100, "RX Sample Rate"=4000000, "Pulse Shaping Parameters"={"Modulation Type"="PSK", "Pulse Shaping Filter"="Root Raised Cos", "Filter Parameter"=0.5, "Filter Length (Symbols)"=8}, "Channel Estimation/Equalization Parameters"={"Equalization Method"="Direct", "Channel Estimate Length"=1, "Equalizer Length"=1, "Equalizer Delay"=-1, "Equalize"=FALSE}}
  "Channel Estimation/Equalization Parameters": T10 = {"Equalization Method"="Indirect", "Channel Estimate Length"=4, "Equalizer Length"=2, "Equalizer Delay"=-1, "Equalize"=FALSE}
  "TX Modulation Parameters": T13 = {"Modulation Type"="QPSK", "Pulse Shaping Parameters"={"Modulation Type"="PSK", "Pulse Shaping Filter"="Root Raised Cos", "Filter Parameter"=0.5, "Filter Length (Symbols)"=8}, "TX Oversample Factor"=20, "Packet Length (Bits)"=500, "TX Sample Rate"=100, "Control Information For Packet Header/Tail"={"Training Sequence "="Length 11 Barker Sequence", "Zero Pad Length"=8}}
  "Synchronization Options": T7 = {"Synchronization Method"="Timing Estimation", "Fixed Offset"=0, "Symbol Timing Recovery Method"="Max Energy", "Frame Detection Method"="Ideal alignment", "Frequency Estimation Method"="Ideal ", "Correct Frequency Offset"=TRUE, "Correct Symbol Timing"=TRUE}
  "Plots": i32
  "TX Channel Model Parameters": T15 = {"Noise Power (dB)"=-Inf, "Channel Response"=[1+0i, 0.35+0.35i], "Frequency Offset"=0, "Delay (sec)"=0, "Channel Model"="ISI"}
outputs:
  "error out": error
  "Received Constellation": cluster{"Element 1": f64[], "Element 2": f64[]}[]
  "Received Eye Diagram": cluster{"t0": f64, "dt": f64, "Y": f64[]}[]
  "Power Delay Profile": waveform<f64>
  "Measured Channel Impairements": T14
  "I Data": waveform<f64>
  "Q Data": waveform<f64>
  "Output metrics": T16
panel indicators:
  "Estimated Offset": i32
  "Estimated offset in time": f64
types:
  T1 = cluster{"Training Sequence Type": string, "Zero Pad Length": i32}
  T2 = enum{"Rectangle", "Raised Cosine", "Root Raised Cos"}
  T3 = cluster{"Modulation Type": enum{"FSK", "PSK", "QAM", "MSK", "PAM", "ASK"}, "Pulse Shaping Filter": T2, "Filter Parameter": f64, "Filter Length (Symbols)": i32}
  T4 = cluster{"Active Antenna": string, "Carrier Frequency (Hz)": f64, "Gain (dB)": f64, "Trigger Level": f64, "Bandwidth (Hz)": f64, "Reference Position (%)": f64, "Capture Time (s)": f64, "Simulate": bool, "Device IP Address": string}
  T5 = cluster{"Active Antenna": string, "Carrier Frequency (Hz)": f64, "Gain (dB)": f64, "Generation Mode": enum{"Single Shot", "Simulate", "Continuous"}, "Device IP Address": string}
  T6 = cluster{"Training Sequence (derived)": c128[], "Zero Pad Length": i32}
  T7 = cluster{"Synchronization Method": string, "Fixed Offset": i32, "Symbol Timing Recovery Method": string, "Frame Detection Method": string, "Frequency Estimation Method": string, "Correct Frequency Offset": bool, "Correct Symbol Timing": bool}
  T8 = enum{"none", "Raised Cosine", "Root Raised Cos", "Gaussian"}
  T9 = cluster{"Modulation Type": enum{"FSK", "PSK", "QAM", "MSK", "PAM", "ASK"}, "Pulse Shaping Filter": T8, "Filter Parameter": f64, "Filter Length (Symbols)": i32}
  T10 = cluster{"Equalization Method": string, "Channel Estimate Length": i32, "Equalizer Length": i32, "Equalizer Delay": i32, "Equalize": bool}
  T11 = cluster{"Modulation Type": string, "Control Information\nfor Packet Header/Tail": T6, "RX Oversample Factor": i32, "Synchronization Options": T7, "Number of Data Symbols (Derived)": i32, "RX Sample Rate": f64, "Pulse Shaping Parameters": T9, "Channel Estimation/Equalization Parameters": T10}
  T12 = cluster{"Training Sequence ": string, "Zero Pad Length": i32}
  T13 = cluster{"Modulation Type": string, "Pulse Shaping Parameters": T9, "TX Oversample Factor": i32, "Packet Length (Bits)": i32, "TX Sample Rate": f64, "Control Information For Packet Header/Tail": T12}
  T14 = cluster{"SNR(dB)": f64, "Channel Estimate": c128[], "Freq. Offset": f64, "Delay": f64}
  T15 = cluster{"Noise Power (dB)": f64, "Channel Response": c128[], "Frequency Offset": f64, "Delay (sec)": f64, "Channel Model": string}
  T16 = cluster{"Average Bit Error Rate": f64, "Timing Error Statistic": f64, "Frequency Error Statistic": f64}
  T17 = cluster{"Modulation Type": enum{"FSK", "PSK", "QAM", "MSK", "PAM", "ASK"}, "Pulse Shaping Filter": enum{"none", "Raised Cosine", "Root Raised Cos"}, "Filter Parameter": f64, "Filter Length (Symbols)": i32}
diagram:
  Property Node(instance in=$"Pulse Shaping Parameters") -> ("Pulse Shaping Filter"=w1, "Filter Parameter"=w2, "Filter Length (Symbols)"=w3, "Modulation Type"=w4)
  case (w1) {
    frame "Rectangle", Default {
      w5 = "none"
    }
    frame "Raised Cosine" {
      w5 = "Raised Cosine"
    }
    frame "Root Raised Cos" {
      w5 = "Root Raised Cos"
    }
  }
  w6 = T17 {"Modulation Type"="QAM", "Pulse Shaping Filter"="Root Raised Cos", "Filter Parameter"=0.5, "Filter Length (Symbols)"=64}
  Property Node(instance in=w6, "Pulse Shaping Filter"=w5, "Filter Parameter"=w2, "Filter Length (Symbols)"=w3, "Modulation Type"=w4) -> (instance out=w7)
  call "Adapt noise power.gvi"(TX Channel Model Parameters In=$"TX Channel Model Parameters", Pulse Shaping Parameters=w7, RX Oversample Factor=$"RX Oversample Factor") -> (TX Channel Model Parameters Out=w8)
  Property Node(instance in=$"RX HW Parameters", "Simulate"=TRUE) -> (instance out=w9)
  Property Node(instance in=$"Control Information for Packet Header/Tail") -> ("Zero Pad Length"=w10)
  Property Node(instance in=T6 {all zero or empty}, "Zero Pad Length"=w10) -> (instance out=w11)
  # Ts
  Property Node(instance in=$"RX Modulation Parameters", "Modulation Type"=$"Modulation Type", "Pulse Shaping Parameters"=w7, "Control Information\nfor Packet Header/Tail"=w11, "RX Oversample Factor"=$"RX Oversample Factor", "Channel Estimation/Equalization Parameters"=$"Channel Estimation/Equalization Parameters", "Synchronization Options"=$"Synchronization Options", "RX Sample Rate"=$"RX Sample Rate") -> (instance out=w12)
  Property Node(instance in=$"TX Modulation Parameters", "Modulation Type"=$"Modulation Type", "Pulse Shaping Parameters"=w7, "TX Oversample Factor"=$"TX Oversample Factor", "Packet Length (Bits)"=$"Packet Length (Bits)", "Control Information For Packet Header/Tail"=$"Control Information for Packet Header/Tail", "TX Sample Rate"=$"TX Sample Rate") -> (instance out=w13)
  Property Node(instance in=$"TX HW Parameters", "Generation Mode"="Simulate") -> (instance out=w14)
  Divide(x=$"RX Oversample Factor", y=$"RX Sample Rate") -> w15
  for (N = $"# of Iterations") {
    # IQ Waveform
    call "top_tx.gvi"(HW Parameters=w14, Modulation Parameters=w13, Channel Model Parameters=w8) -> (error out=w19, Output IQ Waveform=w20)
    call "top_rx.gvi"(error in=w19, Received IQ Waveform=w20, HW Parameters=w9, Modulation Parameters=w12, TX Channel Model Parameters=w8) -> (Eye Diagram=w21, Average Bit-Error Rate=w22, I Data=w23, Q Data=w24, Signal Constellation=w25, Measured Channel Impairements=w26, error out=w27, Offset=w28, Power Delay Profile=w29)
    call "Compute error statistics.gvi"(TX Channel Model Parameters=w8, Measured Channel Impairements=w26, RX Modulation Parameters=w12) -> (Timing error statistic=w30, Frequency error statistic=w31)
    $"Measured Channel Impairements" <- w26
    $"I Data" <- w23
    $"Q Data" <- w24
    $"Received Eye Diagram" <- w21
    $"Received Constellation" <- w25
    $"error out" <- w27
    $"Power Delay Profile" <- w29
    $"Estimated Offset" <- w28
    To Double Precision Float(number=w28) -> w32
    Divide(x=w15, y=$"RX Oversample Factor") -> w33
    Multiply(w32, w33) -> w34
    $"Estimated offset in time" <- w34
    append w22 to w16
    append w30 to w17
    append w31 to w18
  }
  call "Mean (DBL).gvi"(X=w17) -> (mean=w35)
  call "Mean (DBL).gvi"(X=w18) -> (mean=w36)
  call "Mean (DBL).gvi"(X=w16) -> (mean=w37)
  Property Node(instance in=T16 {all zero or empty}, "Average Bit Error Rate"=w37, "Timing Error Statistic"=w35, "Frequency Error Statistic"=w36) -> (instance out=w38)
  $"Output metrics" <- w38
