vi "simulator_SNR_loop_equalisers.gvi"   [LabVIEW NXG]
panel controls:
  "# of Iterations": i32 = 100
  "Control Information for Packet Header/Tail": T1 = {"Training Sequence Type"="Length 11 Barker Sequence", "Zero Pad Length"=8}
  "Pulse Shaping Parameters": T3 = {"Modulation Type"="QAM", "Pulse Shaping Filter"="Root Raised Cos", "Filter Parameter"=0.5, "Filter Length (Symbols)"=64}
  "Packet Length (Bits)": i32 = 1000
  "RX Oversample Factor": i32 = 20
  "RX Sample Rate": f64 = 4000000
  "TX Sample Rate": f64 = 4000000
  "TX Oversample Factor": i32 = 20
  "RX HW Parameters": T4 = {"Active Antenna"="RX1", "Carrier Frequency (Hz)"=915000000, "Gain (dB)"=10, "Trigger Level"=0.01, "Bandwidth (Hz)"=915000000, "Reference Position (%)"=10, "Capture Time (s)"=0.0033, "Simulate"=FALSE, "Device IP Address"="192.168.11.2"}
  "TX Channel Model Parameters": T5 = {"Channel Response"=[1+0i, 0.35+0.35i], "Frequency Offset"=0, "Delay (sec)"=0, "Channel Model"="ISI"}
  "TX HW Parameters": T6 = {"Active Antenna"="TX1", "Carrier Frequency (Hz)"=915000000, "Gain (dB)"=10, "Generation Mode"="Simulate", "Device IP Address"="192.168.11.3"}
  "Modulation Type": string = "QPSK"
  "RX Modulation Parameters": T12 = {"Modulation Type"="QPSK", "Control Information\nfor Packet Header/Tail"={"Training Sequence (derived)"=[], "Zero Pad Length"=0}, "RX Oversample Factor"=20, "Synchronization Options"={"Synchronization Method"="Timing Estimation", "Fixed Offset"=0, "Symbol Timing Recovery Method"="Max Energy", "Frame Detection Method"="Sliding Correlator", "Frequency Estimation Method"="", "Correct Frequency Offset"=FALSE, "Correct Symbol Timing"=FALSE}, "Number of Data Symbols (Derived)"=100, "RX Sample Rate"=4000000, "Pulse Shaping Parameters"={"Modulation Type"="PSK", "Pulse Shaping Filter"="Root Raised Cos", "Filter Parameter"=0.5, "Filter Length (Symbols)"=8}, "Channel Estimation/Equalization Parameters"={"Equalization Method"="Direct", "Channel Estimate Length"=1, "Equalizer Length"=1, "Equalizer Delay"=-1, "Equalize"=FALSE}}
  "Channel Estimation/Equalization Parameters": T11 = {"Equalization Method"="Wiener", "Channel Estimate Length"=2, "Equalizer Length"=11, "Equalizer Delay"=-1, "Equalize"=TRUE}
  "TX Modulation Parameters": T14 = {"Modulation Type"="QPSK", "Pulse Shaping Parameters"={"Modulation Type"="PSK", "Pulse Shaping Filter"="Root Raised Cos", "Filter Parameter"=0.5, "Filter Length (Symbols)"=8}, "TX Oversample Factor"=20, "Packet Length (Bits)"=500, "TX Sample Rate"=100, "Control Information For Packet Header/Tail"={"Training Sequence "="Length 11 Barker Sequence", "Zero Pad Length"=8}}
  "Synchronization Options": T8 = {"Synchronization Method"="Timing Estimation", "Fixed Offset"=0, "Symbol Timing Recovery Method"="Ideal alignment", "Frame Detection Method"="Ideal alignment", "Frequency Estimation Method"="Ideal ", "Correct Frequency Offset"=TRUE, "Correct Symbol Timing"=TRUE}
  "Plots": i32 = 3
  "SNR values": T16 = {"First value"=0, "Last value"=10, "Step"=0.5}
panel indicators:
  "error out": error
  "Received Constellation": cluster{"Element 1": f64[], "Element 2": f64[]}[]
  "Received Eye Diagram": cluster{"t0": f64, "dt": f64, "Y": f64[]}[]
  "Power Delay Profile": waveform<f64>
  "Q Data": waveform<f64>
  "I Data": waveform<f64>
  "Measured Channel Impairements": T15
  "BER vs SNR": cluster{"Element 1": f64[], "Element 2": f64[]}
  "Progress": f64
  "Output metrics": T17
  "BER": f64[]
types:
  T1 = cluster{"Training Sequence Type": string, "Zero Pad Length": i32}
  T2 = enum{"Rectangle", "Raised Cosine", "Root Raised Cos"}
  T3 = cluster{"Modulation Type": enum{"FSK", "PSK", "QAM", "MSK", "PAM", "ASK"}, "Pulse Shaping Filter": T2, "Filter Parameter": f64, "Filter Length (Symbols)": i32}
  T4 = cluster{"Active Antenna": string, "Carrier Frequency (Hz)": f64, "Gain (dB)": f64, "Trigger Level": f64, "Bandwidth (Hz)": f64, "Reference Position (%)": f64, "Capture Time (s)": f64, "Simulate": bool, "Device IP Address": string}
  T5 = cluster{"Channel Response": c128[], "Frequency Offset": f64, "Delay (sec)": f64, "Channel Model": string}
  T6 = cluster{"Active Antenna": string, "Carrier Frequency (Hz)": f64, "Gain (dB)": f64, "Generation Mode": enum{"Single Shot", "Simulate", "Continuous"}, "Device IP Address": string}
  T7 = cluster{"Training Sequence (derived)": c128[], "Zero Pad Length": i32}
  T8 = cluster{"Synchronization Method": string, "Fixed Offset": i32, "Symbol Timing Recovery Method": string, "Frame Detection Method": string, "Frequency Estimation Method": string, "Correct Frequency Offset": bool, "Correct Symbol Timing": bool}
  T9 = enum{"none", "Raised Cosine", "Root Raised Cos", "Gaussian"}
  T10 = cluster{"Modulation Type": enum{"FSK", "PSK", "QAM", "MSK", "PAM", "ASK"}, "Pulse Shaping Filter": T9, "Filter Parameter": f64, "Filter Length (Symbols)": i32}
  T11 = cluster{"Equalization Method": string, "Channel Estimate Length": i32, "Equalizer Length": i32, "Equalizer Delay": i32, "Equalize": bool}
  T12 = cluster{"Modulation Type": string, "Control Information\nfor Packet Header/Tail": T7, "RX Oversample Factor": i32, "Synchronization Options": T8, "Number of Data Symbols (Derived)": i32, "RX Sample Rate": f64, "Pulse Shaping Parameters": T10, "Channel Estimation/Equalization Parameters": T11}
  T13 = cluster{"Training Sequence ": string, "Zero Pad Length": i32}
  T14 = cluster{"Modulation Type": string, "Pulse Shaping Parameters": T10, "TX Oversample Factor": i32, "Packet Length (Bits)": i32, "TX Sample Rate": f64, "Control Information For Packet Header/Tail": T13}
  T15 = cluster{"SNR(dB)": f64, "Channel Estimate": c128[], "Freq. Offset": f64, "Delay": f64}
  T16 = cluster{"First value": f64, "Last value": f64, "Step": f64}
  T17 = cluster{"Average Bit Error Rate": f64, "Timing Error Statistic": f64, "Frequency Error Statistic": f64}
  T18 = cluster{"Noise Power (dB)": f64, "Channel Response": c128[], "Frequency Offset": f64, "Delay (sec)": f64, "Channel Model": string}
diagram:
  Property Node(instance in=$"SNR values") -> ("First value"=w1, "Step"=w2, "Last value"=w3)
  while (iteration -> i1) {
    Multiply(w2, i1) -> w6
    Add(w1, w6) -> w7
    Negate(x=w7) -> w8
    Property Node(instance in=$"TX Channel Model Parameters") -> ("Channel Response"=w9, "Frequency Offset"=w10, "Delay (sec)"=w11, "Channel Model"=w12)
    Property Node(instance in=T18 {all zero or empty}, "Noise Power (dB)"=w8, "Channel Response"=w9, "Frequency Offset"=w10, "Delay (sec)"=w11, "Channel Model"=w12) -> (instance out=w13)
    call "simulator.gvi"(# of Iterations=$"# of Iterations", Control Information for Packet Header/Tail=$"Control Information for Packet Header/Tail", Pulse Shaping Parameters=$"Pulse Shaping Parameters", Packet Length (Bits)=$"Packet Length (Bits)", RX Oversample Factor=$"RX Oversample Factor", RX Sample Rate=$"RX Sample Rate", TX Sample Rate=$"TX Sample Rate", TX Oversample Factor=$"TX Oversample Factor", RX HW Parameters=$"RX HW Parameters", TX HW Parameters=$"TX HW Parameters", Modulation Type=$"Modulation Type", RX Modulation Parameters=$"RX Modulation Parameters", Channel Estimation/Equalization Parameters=$"Channel Estimation/Equalization Parameters", TX Modulation Parameters=$"TX Modulation Parameters", Synchronization Options=$"Synchronization Options", Plots=$Plots, TX Channel Model Parameters=w13) -> (error out=w14, Received Constellation=w15, Received Eye Diagram=w16, Power Delay Profile=w17, Measured Channel Impairements=w18, I Data=w19, Q Data=w20, Output metrics=w21)
    $"Measured Channel Impairements" <- w18
    $"I Data" <- w19
    $"Q Data" <- w20
    $"Received Eye Diagram" <- w16
    $"Received Constellation" <- w15
    $"error out" <- w14
    Is Greater Or Equal(x=w7, y=w3) -> w22
    $"Power Delay Profile" <- w17
    Property Node(instance in=w21) -> ("Average Bit Error Rate"=w23)
    $"Output metrics" <- w21
    Subtract(x=w1, y=w3) -> w24
    Absolute Value(x=w24) -> w25
    Divide(x=w6, y=w25) -> w26
    $Progress <- w26
    append w23 to w4
    append w7 to w5
    stop if w22
  }
  Reverse 1D Array(array=w5) -> (reversed array=w27)
  Reverse 1D Array(array=w4) -> (reversed array=w28)
  Build Cluster(w27, w28) -> w29
  $"BER vs SNR" <- w29
  $BER <- w28
