vi "student_Wiener_filter.gvi"   [LabVIEW NXG]
inputs:
  "Modulation Parameters In": T6 = {"Modulation Type"="QPSK", "Control Information\nfor Packet Header/Tail"={"Training Sequence (derived)"=[], "Zero Pad Length"=0}, "RX Oversample Factor"=20, "Synchronization Options"={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}, "Number of Data Symbols (Derived)"=100, "RX Sample Rate"=4000000, "Pulse Shaping Parameters"={"Modulation Type"="PSK", "Pulse Shaping Filter"="Root Raised Cos", "Filter Parameter"=0.5, "Filter Length (Symbols)"=8}, "Channel Estimation/Equalization Parameters"={"Equalization Method"="", "Channel Estimate Length"=1, "Equalizer Length"=1, "Equalizer Delay"=-1}}
  "equalizer delay": i32
  "channel estimate": c128[]
  "Equalizer length": i32
  "var_symb": f64
  "var_noise": f64
outputs:
  "Modulation Parameters Out": T6
  "Wiener filter coeff": c128[]
  "MSE": f64
panel indicators:
  "Real part of the Wiener coefficients": f64[]
types:
  T1 = cluster{"Training Sequence (derived)": c128[], "Zero Pad Length": i32}
  T2 = cluster{"Synchronization Method": string, "Fixed Offset": i32, "Symbol Timing Recovery Method": string, "Frame Detection Method": string, "Correct Frequency Offset": bool}
  T3 = enum{"none", "Raised Cosine", "Root Raised Cos", "Gaussian"}
  T4 = cluster{"Modulation Type": enum{"FSK", "PSK", "QAM", "MSK", "PAM", "ASK"}, "Pulse Shaping Filter": T3, "Filter Parameter": f64, "Filter Length (Symbols)": i32}
  T5 = cluster{"Equalization Method": string, "Channel Estimate Length": i32, "Equalizer Length": i32, "Equalizer Delay": i32}
  T6 = cluster{"Modulation Type": string, "Control Information\nfor Packet Header/Tail": T1, "RX Oversample Factor": i32, "Synchronization Options": T2, "Number of Data Symbols (Derived)": i32, "RX Sample Rate": f64, "Pulse Shaping Parameters": T4, "Channel Estimation/Equalization Parameters": T5}
diagram:
  # h[-K2] .... h[K1]
  $"Modulation Parameters Out" <- $"Modulation Parameters In"
  # f[0] .... f[K1+K2]
  call "compute_channel_cross_correlation.gvi"(equalizer delay=$"equalizer delay", channel estimate=$"channel estimate", Equalizer length=$"Equalizer length") -> (Formated channel=w1, Channel cross correlation=w2)
  Reverse 1D Array(array=w1) -> (reversed array=w3)
  Complex Conjugate(x + iy=w3) -> w4
  Multiply(w4, $var_symb) -> w5
  Array Size(array=w2) -> (size(s)=w6)
  Complex Conjugate(x + iy=w2) -> w7
  # To build Toeplitz matrix
  call "Create Special Complex Matrix.gvi"(matrix type=2, matrix size=w6, input vector1=w2, input vector2=w7) -> (special matrix=w8)
  # Solve system
  Multiply(w8, $var_symb) -> w9
  Multiply($var_noise, 2) -> w10
  call "Create Special Real Matrix.gvi"(matrix type=0, matrix size=w6) -> (special matrix=w11)
  Multiply(w11, w10) -> w12
  Add(w9, w12) -> w13
  # Dot product
  call "Solve Complex Linear Equations (single right hand).gvi"(input matrix=w13, known vector=w5) -> (solution vector=w14)
  Complex To Real Imaginary(x + iy=w14) -> (x=w15)
  $"Real part of the Wiener coefficients" <- w15
  # Change to the Wiener coeffs
  $"Wiener filter coeff" <- w14
  call "Complex Dot Product.gvi"(x vector=w5, y vector=w14) -> (x * y=w16)
  Subtract(x=$var_symb, y=w16) -> w17
  Complex To Real Imaginary(x + iy=w17) -> (x=w18)
  $MSE <- w18
