vi "Ideal frame alignment.gvi"   [LabVIEW NXG]
inputs:
  "Modulation Parameters In": T7 = {"Modulation Type"="QPSK", "Control Information\nfor Packet Header/Tail"={"Training Sequence (derived)"=[], "Zero Pad Length"=0}, "RX Oversample Factor"=20, "Synchronization Options"={"Synchronization Method"="Timing Estimation", "Fixed Offset"=0, "Symbol Timing Recovery Method"="Max Energy", "Frame Detection Method"="Sliding Correlator", "Frequency Estimation Method"="", "Correct Frequency Offset"=FALSE, "Correct Symbol Timing"=FALSE}, "Number of Data Symbols (Derived)"=100, "RX Sample Rate"=4000000, "Pulse Shaping Parameters"={"Modulation Type"="PSK", "Pulse Shaping Filter"="Root Raised Cos", "Filter Parameter"=0.5, "Filter Length (Symbols)"=8}, "Channel Estimation/Equalization Parameters"={"Equalization Method"="Direct", "Channel Estimate Length"=1, "Equalizer Length"=1, "Equalizer Delay"=-1, "Equalize"=FALSE}}
  "Input Complex Waveform": cluster{"t0": f64, "dt": f64, "Y": c128[]} = {"t0"=0, "dt"=1, "Y"=[]}
  "TX Channel Model Parameters": T1 = {"Noise Power (dB)"=-Inf, "Channel Response"=[], "Frequency Offset"=0, "Delay (sec)"=0, "Channel Model"="AWGN"}
  "Alignment Offset": f64
outputs:
  "Output": c128[]
  "Frame Alignment Offset": f64
  "Frequency Offset": f64
panel indicators:
  "x": f64[]
  "x_2": f64[]
types:
  T1 = cluster{"Noise Power (dB)": f64, "Channel Response": c128[], "Frequency Offset": f64, "Delay (sec)": f64, "Channel Model": string}
  T2 = cluster{"Training Sequence (derived)": c128[], "Zero Pad Length": i32}
  T3 = cluster{"Synchronization Method": string, "Fixed Offset": i32, "Symbol Timing Recovery Method": string, "Frame Detection Method": string, "Frequency Estimation Method": string, "Correct Frequency Offset": bool, "Correct Symbol Timing": bool}
  T4 = enum{"none", "Raised Cosine", "Root Raised Cos", "Gaussian"}
  T5 = cluster{"Modulation Type": enum{"FSK", "PSK", "QAM", "MSK", "PAM", "ASK"}, "Pulse Shaping Filter": T4, "Filter Parameter": f64, "Filter Length (Symbols)": i32}
  T6 = cluster{"Equalization Method": string, "Channel Estimate Length": i32, "Equalizer Length": i32, "Equalizer Delay": i32, "Equalize": bool}
  T7 = cluster{"Modulation Type": string, "Control Information\nfor Packet Header/Tail": T2, "RX Oversample Factor": i32, "Synchronization Options": T3, "Number of Data Symbols (Derived)": i32, "RX Sample Rate": f64, "Pulse Shaping Parameters": T5, "Channel Estimation/Equalization Parameters": T6}
diagram:
  Property Node(instance in=$"Input Complex Waveform") -> ("Y"=w1)
  Property Node(instance in=$"Modulation Parameters In") -> (instance out=w2, "RX Oversample Factor"=w3, "RX Sample Rate"=w4, "Synchronization Options:Correct Frequency Offset"=w5, "Control Information\nfor Packet Header/Tail:Zero Pad Length"=w6, "Pulse Shaping Parameters:Pulse Shaping Filter"=w7, "Pulse Shaping Parameters:Filter Length (Symbols)"=w8)
  case (w7) {
    frame "none", Default {
      w9 = 1
    }
    frame "Raised Cosine" {
      Divide(x=w8, y=2) -> w10
      Round Toward Positive Infinity(x=w10) -> w9
    }
    frame "Root Raised Cos" {
      w9 = w8
    }
    frame "Gaussian" {
      w9 = 0
    }
  }
  Property Node(instance in=$"TX Channel Model Parameters") -> (instance out=w11, "Delay (sec)"=w12)
  Divide(x=$"Alignment Offset", y=w4) -> w13
  Subtract(x=w12, y=w13) -> w14
  Is Greater Than 0(x=w14) -> w15
  Divide(x=w3, y=w4) -> w16
  Absolute Value(x=w14) -> w17
  Quotient And Remainder(x=w17, y=w16) -> (floor(x/y)=w18)
  Negate(x=w18) -> w19
  Select(s=w15, t=w18, f=w19) -> w20
  Add(w20, w9) -> w21
  Add(w6, w21) -> w22
  Array Subset(array=w1, index0=w22) -> w23
  Complex To Real Imaginary(x + iy=w23) -> (x=w24)
  $x_2 <- w24
  Complex To Real Imaginary(x + iy=w1) -> (x=w25)
  $x <- w25
  case (w5) {
    frame False, Default {
      call "moose.gviprotected"(Modulation Parameters In=w2, input=w23, TX Channel Model Parameters=w11) -> (frequency offset=w27)
      w26 = w23
    }
    frame True {
      call "moose.gviprotected"(Modulation Parameters In=w2, input=w23, TX Channel Model Parameters=w11) -> (output=w26, frequency offset=w27)
    }
  }
  $Output <- w26
  $"Frequency Offset" <- w27
  $"Frame Alignment Offset" <- w21
