vi "top_tx.gvi"   [LabVIEW NXG]
inputs:
  "HW Parameters": T4 = {"Active Antenna"="TX1", "Carrier Frequency (Hz)"=400000000, "Gain (dB)"=30, "Generation Mode"="Continuous", "Device IP Address"="192.168.10.53"}
  "Modulation Parameters": T8 = {"Modulation Type"="QPSK", "Pulse Shaping Parameters"={"Modulation Type"="PSK", "Pulse Shaping Filter"="Root Raised Cos", "Filter Parameter"=0.5, "Filter Length (Symbols)"=8}, "TX Oversample Factor"=4, "Packet Length (Bits)"=500, "TX Sample Rate"=1000000, "Control Information For Packet Header/Tail"={"Training Sequence "="Length 11 Barker Sequence", "Zero Pad Length"=8}}
  "Channel Model Parameters": T3 = {"Noise Power (dB)"=-Inf, "Channel Response"=[], "Frequency Offset"=0, "Delay (sec)"=0, "Channel Model"="AWGN"}
  "error in": error
  "STOP": bool
  "Transmit Iterations": i32
outputs:
  "Queues Out": T1
  "error out": error
  "Transmitting": bool
  "packet duration (sec)": f64
  "Output IQ Waveform": cluster{"t0": f64, "dt": f64, "Y": c128[]}
  "symbol rate (Hz)": f64
  "actual delay (sec)": f64
panel controls:
  "Plots": i32
  "Parameters": i32 = 2
panel indicators:
  "key bit sequence": u8[]
  "data symbols": c128[]
  "coerced carrier frequency (Hz)": f64
  "coerced gain (dB)": f64
  "Eye Diagram": cluster{"t0": f64, "dt": f64, "Y": f64[]}[]
  "Transmitted Constellation": T2[]
  "number of data symbols": i32
types:
  T1 = cluster{"Key Bit Sequence Queue": Queue<u8[]>, "Training Sequence Queue": Queue<c128[]>}
  T2 = cluster{"constellation": f64[], "oversampled data": f64[]}
  T3 = cluster{"Noise Power (dB)": f64, "Channel Response": c128[], "Frequency Offset": f64, "Delay (sec)": f64, "Channel Model": string}
  T4 = cluster{"Active Antenna": string, "Carrier Frequency (Hz)": f64, "Gain (dB)": f64, "Generation Mode": enum{"Single Shot", "Simulate", "Continuous"}, "Device IP Address": string}
  T5 = enum{"none", "Raised Cosine", "Root Raised Cos", "Gaussian"}
  T6 = cluster{"Modulation Type": enum{"FSK", "PSK", "QAM", "MSK", "PAM", "ASK"}, "Pulse Shaping Filter": T5, "Filter Parameter": f64, "Filter Length (Symbols)": i32}
  T7 = cluster{"Training Sequence ": string, "Zero Pad Length": i32}
  T8 = cluster{"Modulation Type": string, "Pulse Shaping Parameters": T6, "TX Oversample Factor": i32, "Packet Length (Bits)": i32, "TX Sample Rate": f64, "Control Information For Packet Header/Tail": T7}
diagram:
  case ($"error in") {
    frame No Error {
      call "TXRF_init.gvi"(HW Parameters In=$"HW Parameters", Modulation Parameters In=$"Modulation Parameters", error in=$"error in") -> (error out=w3, HW Parameters Out=w4, Modulation Parameters Out=w5, Queues out=w6, coerced carrier frequency (Hz)=w7, coerced gain (dB)=w8, USRP Session out=w9)
      call "transmitter.gvi"(HW Parameters In=w4, Modulation Parameters In=w5, Channel Model Parameters=$"Channel Model Parameters", error in=w3, Queues In=w6) -> (error out=w10, HW Parameters Out=w11, Modulation Parameters Out=w12, Output Complex Waveform=w13, Actual Delay (Sec)=w14, Data Symbols=w15, Number of Data Symbols=w16, Key Bit Sequence=w17, Queues Out=w18, Eye Diagram=w19, Transmitted Constellation=w20)
      $"key bit sequence" <- w17
      $"Eye Diagram" <- w19
      Property Node(instance in=w12) -> ("TX Oversample Factor"=w21, "TX Sample Rate"=w22)
      Divide(x=w22, y=w21) -> w23
      $"symbol rate (Hz)" <- w23
      Property Node(instance in=w13) -> ("Y"=w24)
      Array Size(array=w24) -> (size(s)=w25)
      Divide(x=w25, y=w22) -> w26
      $"packet duration (sec)" <- w26
      Property Node(instance in=w11) -> ("Generation Mode"=w27)
      case (w27) {
        frame "Single Shot" {
          call "TXRF_prepare_for_transmit.gvi"(IQ Data=w13, error in=w10) -> (Scaled and Padded IQ Data=w28, error out=w29)
          for (N = $"Transmit Iterations") {
            call "TXRF_send.gvi"(USRP Session in=w9, error in=w29, IQ Data in=w28, end of data?=TRUE, HW Parameters In=w11) -> (error out=w30, USRP Session out=w31)
          }
          call "niUSRP Close Session.gvi"(Handle in=w31, error in (no error)=w30) -> (Error Out=w1)
        }
        frame "Simulate" {
          w1 = w10
        }
        frame "Continuous", Default {
          call "TXRF_prepare_for_transmit.gvi"(IQ Data=w13, error in=w10) -> (Scaled and Padded IQ Data=w32, error out=w33)
          while {
            Not(x=TRUE) -> w34
            $Transmitting <- TRUE
            call "TXRF_send.gvi"(USRP Session in=w9, error in=w33, IQ Data in=w32, end of data?=TRUE, HW Parameters In=w11) -> (error out=w35, USRP Session out=w36)
            Property Node(instance in=w35) -> ("status"=w37)
            Logical Or(w37, $STOP) -> w38
            stop if w38
          }
          $Transmitting <- w34
          call "niUSRP Close Session.gvi"(Handle in=w36, error in (no error)=w35) -> (Error Out=w1)
        }
      }
      $"Output IQ Waveform" <- w13
      $"Queues Out" <- w18
      $"Transmitted Constellation" <- w20
      $"actual delay (sec)" <- w14
      $"data symbols" <- w15
      $"number of data symbols" <- w16
      $"coerced carrier frequency (Hz)" <- w7
      $"coerced gain (dB)" <- w8
      w2 = FALSE
    }
    frame Error {
      w1 = $"error in"
      w2 = FALSE
    }
  }
  $STOP <- w2
  $"error out" <- w1
