vi "RXRF_init.gvi"   [LabVIEW NXG]
inputs:
  "HW Parameters In": T2 = {"Active Antenna"="RX1", "Carrier Frequency (Hz)"=915000000, "Gain (dB)"=10, "Trigger Level"=0.01, "Bandwidth (Hz)"=915000000, "Reference Position (%)"=10, "Capture Time (s)"=0.0033, "Simulate"=FALSE, "Device IP Address"="192.168.10.2"}
  "Modulation Parameters In": T8 = {"Modulation Type"="QPSK", "Control Information\nfor Packet Header/Tail"={"Training Sequence (derived)"=[], "Zero Pad Length"=0}, "RX Oversample Factor"=20, "Synchronization Options"={"Synchronization Method"="Timing Estimation", "Fixed Offset"=0, "Symbol Timing Recovery Method"="Max Energy", "Frame Detection Method"="Sliding Correlator", "Frequency Estimation Method"="", "Correct Frequency Offset"=FALSE, "Correct Symbol Timing"=FALSE}, "Number of Data Symbols (Derived)"=100, "RX Sample Rate"=4000000, "Pulse Shaping Parameters"={"Modulation Type"="PSK", "Pulse Shaping Filter"="Root Raised Cos", "Filter Parameter"=0.5, "Filter Length (Symbols)"=8}, "Channel Estimation/Equalization Parameters"={"Equalization Method"="Direct", "Channel Estimate Length"=1, "Equalizer Length"=1, "Equalizer Delay"=-1, "Equalize"=FALSE}}
  "error in (no error)": error
outputs:
  "error out": error
  "HW Parameters Out": T2
  "Modulation Parameters Out": T8
  "Queues out": T1
  "USRP Session out": niUSRP
types:
  T1 = cluster{"Element 1": Queue<u8[]>, "Element 2": Queue<c128[]>}
  T2 = cluster{"Active Antenna": string, "Carrier Frequency (Hz)": f64, "Gain (dB)": f64, "Trigger Level": f64, "Bandwidth (Hz)": f64, "Reference Position (%)": f64, "Capture Time (s)": f64, "Simulate": bool, "Device IP Address": string}
  T3 = cluster{"Training Sequence (derived)": c128[], "Zero Pad Length": i32}
  T4 = cluster{"Synchronization Method": string, "Fixed Offset": i32, "Symbol Timing Recovery Method": string, "Frame Detection Method": string, "Frequency Estimation Method": string, "Correct Frequency Offset": bool, "Correct Symbol Timing": bool}
  T5 = enum{"none", "Raised Cosine", "Root Raised Cos", "Gaussian"}
  T6 = cluster{"Modulation Type": enum{"FSK", "PSK", "QAM", "MSK", "PAM", "ASK"}, "Pulse Shaping Filter": T5, "Filter Parameter": f64, "Filter Length (Symbols)": i32}
  T7 = cluster{"Equalization Method": string, "Channel Estimate Length": i32, "Equalizer Length": i32, "Equalizer Delay": i32, "Equalize": bool}
  T8 = cluster{"Modulation Type": string, "Control Information\nfor Packet Header/Tail": T3, "RX Oversample Factor": i32, "Synchronization Options": T4, "Number of Data Symbols (Derived)": i32, "RX Sample Rate": f64, "Pulse Shaping Parameters": T6, "Channel Estimation/Equalization Parameters": T7}
diagram:
  $"Modulation Parameters Out" <- $"Modulation Parameters In"
  case ($"error in (no error)") {
    frame No Error {
      Obtain Queue(element data type=u8[] [], name (unnamed)="Key Bit Sequence Queue") -> (queue out=w3)
      Obtain Queue(element data type=c128[] [], name (unnamed)="Training Sequence Queue") -> (queue out=w4)
      Build Cluster(w3, w4) -> w5
      $"Queues out" <- w5
      Property Node(instance in=$"HW Parameters In") -> ("Simulate"=w6)
      case (w6) {
        frame False, Default {
          Property Node(instance in=$"HW Parameters In") -> (instance out=w2, "Device IP Address"=w7)
          call "niUSRP Open Rx Session.gvi"(Device names=w7, Reset=TRUE, error in (no error)=$"error in (no error)") -> (Error Out=w8, Session handle=w9)
          Property Node(instance in=w9, error in=w8, "Clocking and Synchronization:Reference Frequency Source"="Internal", "Clocking and Synchronization:Timebase Clock Source"="Internal") -> (instance out=w10, error out=w11)
          call "niUSRP Commit.gvi"(session handle=w10, error in (no error)=w11) -> (session handle out=w12, Error Out=w1)
          $"USRP Session out" <- w12
          sequence {
            frame 0 {
              Wait Ms(msToWait=0)
            }
          }
        }
        frame True {
          w2 = $"HW Parameters In"
          w1 = $"error in (no error)"
        }
      }
    }
    frame Error {
      w1 = $"error in (no error)"
      w2 = $"HW Parameters In"
    }
  }
  $"HW Parameters Out" <- w2
  $"error out" <- w1
