vi "IEEE_802.11a_short_training.gvi"   [LabVIEW NXG]
inputs:
  "Modulation Parameters In": T4 = {"Modulation Type"="QPSK", "Pulse Shaping Parameters"={"Modulation Type"="PSK", "Pulse Shaping Filter"="Root Raised Cos", "Filter Parameter"=0.5, "Filter Length (Symbols)"=8}, "TX Oversample Factor"=20, "Packet Length (Bits)"=500, "TX Sample Rate"=100, "Control Information For Packet Header/Tail"={"Training Sequence "="Length 11 Barker Sequence", "Zero Pad Length"=8}}
  "error in (no error)": error
outputs:
  "Short Training Sequence": c128[]
  "error out": error
types:
  T1 = enum{"none", "Raised Cosine", "Root Raised Cos", "Gaussian"}
  T2 = cluster{"Modulation Type": enum{"FSK", "PSK", "QAM", "MSK", "PAM", "ASK"}, "Pulse Shaping Filter": T1, "Filter Parameter": f64, "Filter Length (Symbols)": i32}
  T3 = cluster{"Training Sequence ": string, "Zero Pad Length": i32}
  T4 = cluster{"Modulation Type": string, "Pulse Shaping Parameters": T2, "TX Oversample Factor": i32, "Packet Length (Bits)": i32, "TX Sample Rate": f64, "Control Information For Packet Header/Tail": T3}
diagram:
  case ($"error in (no error)") {
    frame No Error {
      # Generate pilot tones for short training sequence as defined in IEEE 802.11a standard
      # S?26, 26 = sqrt(13/6) x {0, 0, 1+j, 0, 0, 0, -1-j, 0, 0, 0, 1+j, 0, 0, 0, -1-j, 0, 0, 0, -1-j, 0, 0, 0, 1+j, 0, 0, 0, 0,
      # 0, 0, 0, -1-j, 0, 0, 0, -1-j, 0, 0, 0, 1+j, 0, 0, 0, 1+j, 0, 0, 0, 1+j, 0, 0, 0, 1+j, 0,0}
      Property Node(instance in=$"Modulation Parameters In", "Modulation Type"="QPSK") -> (instance out=w2)
      Interleave Array([0, 1, 0, 1, 1, 0], [0, 1, 0, 1, 1, 0]) -> w3
      # normalize energy
      # of OFDM symbol
      Divide(x=26, y=6) -> w4
      # Pilot tones
      call "modulate.gviprotected"(Error In=$"error in (no error)", Input Bit Stream=w3, Modulation Parameters In=w2, Symbol Energy (1)=w4) -> (Output Symbols=w5, Error Out=w6)
      Interleave Array([1, 1, 0, 0, 0, 0], [1, 1, 0, 0, 0, 0]) -> w7
      call "modulate.gviprotected"(Error In=w6, Input Bit Stream=w7, Modulation Parameters In=w2, Symbol Energy (1)=w4) -> (Output Symbols=w8, Error Out=w9)
      # Pilot tones
      # Insert zero pilot tones
      # where appropriate
      Build Array[ConcatenateInputs=True](0+0i, w8, 0+0i, 0+0i, 0+0i, w5) -> w10
      # OFDM frame (64 tones)
      Initialize Array(element=0+0i, size=64) -> w11
      # Insert pilot tones into appropriate locations
      # (i.e. at every 4th tone)
      # Insert pilots at every 4th tone
      # Take 64-point IFFT
      s1 = w11  # shift register
      for (iteration -> i1) {
        w12 = each element of w10
        Multiply(4, i1) -> w13
        Replace Array Subset(inArray=s1, w13, w12) -> w14
        next s1 = w14
      }
      call "Inverse Complex FFT.gvi"(FFT {x}=s1) -> (x=w15, error=w16)
      Array Subset(array=w15, length0=16) -> w17
      Build Array[ConcatenateInputs=True](w15, w17) -> w18
      Build Array[ConcatenateInputs=True](w18, w18) -> w19
      $"Short Training Sequence" <- w19
      call "Error Cluster From Error Code.gvi"(error code (0)=w16, error message ("")="IFFT error", error in (no error)=w9) -> (error out=w1)
    }
    frame Error {
      w1 = $"error in (no error)"
    }
  }
  $"error out" <- w1
