vi "OFDM_simulator.gvi"   [LabVIEW NXG]
inputs:
  "# of Iterations": i32 = 1
  "Pulse Shaping Parameters": T2 = {"Modulation Type"="PSK", "Pulse Shaping Filter"="none", "Filter Parameter"=0.5, "Filter Length (symbols)"=8}
  "Packet Length (bits)": i32 = 500
  "RX oversample factor": i32 = 4
  "RX Sample Rate": f64 = 4000000
  "TX Sample Rate": f64 = 4000000
  "TX Oversample Factor": i32 = 4
  "OFDM Parameters": T3 = {"FFT size (N)"=64, "Length of CP (Lc)"=8, "Null Tones"=[0, 30, 31, 32], "Number of OFDM Symbols (derived)"=1, "Training Sequence FFT size"=64, "Training Sequence Length of CP"=8}
  "Equalize Channel": bool
  "TX HW Parameters": T4 = {"Device IP Address"="192.168.10.3", "Active Antenna"="TX1", "Carrier Frequency (Hz)"=915000000, "Gain (dB)"=10, "Generation Mode"="Single Shot"}
  "TX Modulation Parameters": T7 = {"Modulation Type"="QPSK", "Pulse Shaping Parameters"={"Modulation Type"="PSK", "Pulse Shaping Filter"="Root Raised Cos", "Filter Parameter"=0.5, "Filter Length (Symbols)"=8}, "TX Oversample Factor"=20, "Packet Length (Bits)"=500, "TX Sample Rate"=100, "Control Information For Packet Header/Tail"={"Training Sequence "="IEEE 802.11a Short", "Zero Pad Length"=8}}
  "RX Modulation Parameters": T11 = {"Control Information\nfor Packet Header/Tail"={"Training Sequence Type"="IEEE 802.11a Short", "Training Sequence (derived)"=[], "Zero Pad Length"=0}, "RX Oversample Factor"=20, "Synchronization Options"={"Synchronization Method"="Timing Estimation", "Fixed Offset"=0, "Symbol Timing Recovery Method"="Max Energy", "Frame Detection Method"="Sliding Correlator", "Correct Frequency Offset"=FALSE}, "Number of Data Symbols (Derived)"=100, "RX Sample Rate"=4000000, "Pulse Shaping Parameters"={"Modulation Type"="PSK", "Pulse Shaping Filter"="Root Raised Cos", "Filter Parameter"=0.5, "Filter Length (Symbols)"=8}, "Channel Estimation/Equalization Parameters"={"Equalization Method"="Direct", "Channel Estimate Length"=1, "Equalizer Length"=1, "Equalizer Delay"=-1}, "Equalize Channel"=FALSE, "Modulation Type"="QPSK"}
  "RX HW Parameters": T12 = {"Device IP Address"="192.168.10.2", "Active Antenna"="RX1", "Carrier Frequency (Hz)"=915000000, "Gain (dB)"=10, "Trigger Level"=0.01, "Bandwidth (Hz)"=39600000, "Reference Position (%)"=10, "Capture Time (sec)"=0.0005, "Simulate"=FALSE}
  "TX Channel Model Parameters": T13 = {"Noise Power (dB)"=-Inf, "Channel Response"=[], "Frequency Offset"=0, "Delay (sec)"=0, "Channel Model"="AWGN"}
  "Control Information For Packet Header/Tail": T6 = {"Training Sequence "="IEEE 802.11a Short", "Zero Pad Length"=8}
  "Modulation Type": string = "QPSK"
  "Synchronization Options": T9 = {"Synchronization Method"="Timing Estimation", "Fixed Offset"=0, "Symbol Timing Recovery Method"="Max Energy", "Frame Detection Method"="Self Reference w/ Power Normalization", "Correct Frequency Offset"=FALSE}
  "Channel Estimation/Equalization Parameters": T10 = {"Equalization Method"="Direct", "Channel Estimate Length"=4, "Equalizer Length"=4, "Equalizer Delay"=-1}
outputs:
  "Average Bit-Error Rate": f64
  "Power Delay Profile": waveform<f64>
  "error out": error
  "I Data": waveform<f64>
  "Q Data": waveform<f64>
  "Measured Channel Impairements": T14
  "Received Constellation": cluster{"Element 1": f64[], "Element 2": f64[]}[]
  "Received Eye Diagram": cluster{"t0": f64, "dt": f64, "Y": f64[]}[]
  "Estimated Offset": i32
  "Error Statistic": f64
panel controls:
  "Plots": i32
types:
  T1 = enum{"none", "Raised Cosine", "Root Raised Cos", "Gaussian"}
  T2 = cluster{"Modulation Type": enum{"FSK", "PSK", "QAM", "MSK", "PAM", "ASK"}, "Pulse Shaping Filter": T1, "Filter Parameter": f64, "Filter Length (symbols)": i32}
  T3 = cluster{"FFT size (N)": i32, "Length of CP (Lc)": i32, "Null Tones": u32[], "Number of OFDM Symbols (derived)": i32, "Training Sequence FFT size": i32, "Training Sequence Length of CP": i32}
  T4 = cluster{"Device IP Address": string, "Active Antenna": string, "Carrier Frequency (Hz)": f64, "Gain (dB)": f64, "Generation Mode": enum{"Single Shot", "Simulate", "Continuous"}}
  T5 = cluster{"Modulation Type": enum{"FSK", "PSK", "QAM", "MSK", "PAM", "ASK"}, "Pulse Shaping Filter": T1, "Filter Parameter": f64, "Filter Length (Symbols)": i32}
  T6 = cluster{"Training Sequence ": string, "Zero Pad Length": i32}
  T7 = cluster{"Modulation Type": string, "Pulse Shaping Parameters": T5, "TX Oversample Factor": i32, "Packet Length (Bits)": i32, "TX Sample Rate": f64, "Control Information For Packet Header/Tail": T6}
  T8 = cluster{"Training Sequence Type": string, "Training Sequence (derived)": c128[], "Zero Pad Length": i32}
  T9 = cluster{"Synchronization Method": string, "Fixed Offset": i32, "Symbol Timing Recovery Method": string, "Frame Detection Method": string, "Correct Frequency Offset": bool}
  T10 = cluster{"Equalization Method": string, "Channel Estimate Length": i32, "Equalizer Length": i32, "Equalizer Delay": i32}
  T11 = cluster{"Control Information\nfor Packet Header/Tail": T8, "RX Oversample Factor": i32, "Synchronization Options": T9, "Number of Data Symbols (Derived)": i32, "RX Sample Rate": f64, "Pulse Shaping Parameters": T5, "Channel Estimation/Equalization Parameters": T10, "Equalize Channel": bool, "Modulation Type": string}
  T12 = cluster{"Device IP Address": string, "Active Antenna": string, "Carrier Frequency (Hz)": f64, "Gain (dB)": f64, "Trigger Level": f64, "Bandwidth (Hz)": f64, "Reference Position (%)": f64, "Capture Time (sec)": f64, "Simulate": bool}
  T13 = cluster{"Noise Power (dB)": f64, "Channel Response": c128[], "Frequency Offset": f64, "Delay (sec)": f64, "Channel Model": string}
  T14 = cluster{"SNR(dB)": f64, "Channel Estimate": c128[], "Freq. Offset": f64, "Delay": f64}
diagram:
  call "Adapt noise power.gvi"(TX Channel Model Parameters In=$"TX Channel Model Parameters", Pulse Shaping Parameters=$"Pulse Shaping Parameters", RX Oversample Factor=$"RX oversample factor") -> (TX Channel Model Parameters Out=w1)
  Property Node(instance in=$"RX HW Parameters", "Simulate"=TRUE) -> (instance out=w2)
  Property Node(instance in=$"TX HW Parameters", "Generation Mode"="Simulate") -> (instance out=w3)
  Property Node(instance in=w1) -> ("Delay (sec)"=w4)
  Property Node(instance in=$"Control Information For Packet Header/Tail") -> ("Zero Pad Length"=w5, "Training Sequence "=w6)
  Property Node(instance in=T8 {all zero or empty}, "Zero Pad Length"=w5, "Training Sequence Type"=w6) -> (instance out=w7)
  Property Node(instance in=$"RX Modulation Parameters", "Modulation Type"=$"Modulation Type", "Pulse Shaping Parameters"=$"Pulse Shaping Parameters", "Control Information\nfor Packet Header/Tail"=w7, "RX Oversample Factor"=$"RX oversample factor", "Channel Estimation/Equalization Parameters"=$"Channel Estimation/Equalization Parameters", "Synchronization Options"=$"Synchronization Options", "RX Sample Rate"=$"RX Sample Rate", "Equalize Channel"=$"Equalize Channel") -> (instance out=w8)
  Property Node(instance in=$"TX Modulation Parameters", "Modulation Type"=$"Modulation Type", "Pulse Shaping Parameters"=$"Pulse Shaping Parameters", "TX Oversample Factor"=$"TX Oversample Factor", "Packet Length (Bits)"=$"Packet Length (bits)", "Control Information For Packet Header/Tail"=$"Control Information For Packet Header/Tail", "TX Sample Rate"=$"TX Sample Rate") -> (instance out=w9)
  Divide(x=$"RX oversample factor", y=$"RX Sample Rate") -> w10
  for (N = $"# of Iterations") (after w4) (after w10) {
    # IQ Waveform
    call "top_ofdm_tx.gvi"(HW Parameters=w3, Modulation Parameters=w9, Channel Model Parameters=w1, OFDM Parameters=$"OFDM Parameters") -> (error out=w13, Output IQ Waveform=w14)
    call "top_ofdm_rx.gvi"(HW Parameters=w2, Modulation Parameters=w8, error in=w13, Received IQ Waveform=w14, OFDM Parameters=$"OFDM Parameters", # of Receive Iterations=1) -> (error out=w15, Measured Channel Impairements=w16, Offset=w17, Received Constellation=w18, Eye Diagram=w19, Q Data=w20, I Data=w21, Power Delay Profile=w22, Average Bit-Error Rate=w23)
    call "Compute error statistics.gvi"(TX Channel Model Parameters=w1, Measured Channel Impairements=w16, RX Modulation Parameters=w8) -> (Timing error statistic=w24)
    $"error out" <- w15
    append w24 to w11
    append w23 to w12
  }
  call "Mean (DBL).gvi"(X=w11) -> (mean=w25)
  $"Error Statistic" <- w25
  $"Measured Channel Impairements" <- w16
  call "Mean (DBL).gvi"(X=w12) -> (mean=w26)
  $"Average Bit-Error Rate" <- w26
  $"I Data" <- w21
  $"Q Data" <- w20
  $"Received Eye Diagram" <- w19
  $"Received Constellation" <- w18
  $"Power Delay Profile" <- w22
  $"Estimated Offset" <- w17
