vi "OFDM_simulator_frequency_loop.gvi"   [LabVIEW NXG]
panel controls:
  "frequency values": T1 = {"First value"=0, "Last value"=1000, "Step"=100}
  "# of Iterations": i32 = 100
  "Pulse Shaping Parameters": T3 = {"Modulation Type"="PSK", "Pulse Shaping Filter"="none", "Filter Parameter"=0.5, "Filter Length (symbols)"=8}
  "Packet Length (bits)": i32 = 500
  "RX oversample factor": i32 = 4
  "RX Sample Rate": f64 = 4000000
  "TX Sample Rate": f64 = 4000000
  "TX Oversample Factor": i32 = 4
  "Control Information For Packet Header/Tail": T4 = {"Training Sequence "="IEEE 802.11a Short", "Zero Pad Length"=8}
  "Modulation Type": string = "QPSK"
  "Synchronization Options": T5 = {"Synchronization Method"="Timing Estimation", "Fixed Offset"=0, "Symbol Timing Recovery Method"="Max Energy", "Frame Detection Method"="Self Reference w/ Power Normalization", "Correct Frequency Offset"=FALSE}
  "Channel Estimation/Equalization Parameters": T6 = {"Equalization Method"="Direct", "Channel Estimate Length"=4, "Equalizer Length"=4, "Equalizer Delay"=-1}
  "TX Channel Model Parameters": T7 = {"Noise Power (dB)"=-Inf, "Channel Response"=[], "Delay (sec)"=0, "Channel Model"="AWGN"}
  "Equalize Channel": bool
  "Plots": i32
  "OFDM Parameters": T9 = {"FFT size (N)"=64, "Length of CP (Lc)"=8, "Null Tones"=[0, 30, 31, 32], "Number of OFDM Symbols (derived)"=1, "Training Sequence FFT size"=64, "Training Sequence Length of CP"=8}
  "TX HW Parameters": T10 = {"Device IP Address"="192.168.10.3", "Active Antenna"="TX1", "Carrier Frequency (Hz)"=915000000, "Gain (dB)"=10, "Generation Mode"="Single Shot"}
  "RX HW Parameters": T11 = {"Device IP Address"="192.168.10.2", "Active Antenna"="RX1", "Carrier Frequency (Hz)"=915000000, "Gain (dB)"=10, "Trigger Level"=0.01, "Bandwidth (Hz)"=39600000, "Reference Position (%)"=10, "Capture Time (sec)"=0.0005, "Simulate"=FALSE}
  "TX Modulation Parameters": T13 = {"Modulation Type"="QPSK", "Pulse Shaping Parameters"={"Modulation Type"="PSK", "Pulse Shaping Filter"="Root Raised Cos", "Filter Parameter"=0.5, "Filter Length (Symbols)"=8}, "TX Oversample Factor"=20, "Packet Length (Bits)"=500, "TX Sample Rate"=100, "Control Information For Packet Header/Tail"={"Training Sequence "="IEEE 802.11a Short", "Zero Pad Length"=8}}
  "RX Modulation Parameters": T15 = {"Control Information\nfor Packet Header/Tail"={"Training Sequence Type"="IEEE 802.11a Short", "Training Sequence (derived)"=[], "Zero Pad Length"=0}, "RX Oversample Factor"=20, "Synchronization Options"={"Synchronization Method"="Timing Estimation", "Fixed Offset"=0, "Symbol Timing Recovery Method"="Max Energy", "Frame Detection Method"="Sliding Correlator", "Correct Frequency Offset"=FALSE}, "Number of Data Symbols (Derived)"=100, "RX Sample Rate"=4000000, "Pulse Shaping Parameters"={"Modulation Type"="PSK", "Pulse Shaping Filter"="Root Raised Cos", "Filter Parameter"=0.5, "Filter Length (Symbols)"=8}, "Channel Estimation/Equalization Parameters"={"Equalization Method"="Direct", "Channel Estimate Length"=1, "Equalizer Length"=1, "Equalizer Delay"=-1}, "Equalize Channel"=FALSE, "Modulation Type"="QPSK"}
panel indicators:
  "BER vs frequency offset": cluster{"Element 1": f64[], "Element 2": f64[]}
  "Progress": f64
  "BER": f64[]
  "Average Bit-Error Rate": f64
  "Error Statistic": f64
  "Estimated Offset": i32
  "error out": error
  "Received Constellation": cluster{"Element 1": f64[], "Element 2": f64[]}[]
  "Received Eye Diagram": cluster{"t0": f64, "dt": f64, "Y": f64[]}[]
  "Power Delay Profile": waveform<f64>
  "Q Data": waveform<f64>
  "I Data": waveform<f64>
  "Measured Channel Impairements": T8
types:
  T1 = cluster{"First value": f64, "Last value": f64, "Step": f64}
  T2 = enum{"none", "Raised Cosine", "Root Raised Cos", "Gaussian"}
  T3 = cluster{"Modulation Type": enum{"FSK", "PSK", "QAM", "MSK", "PAM", "ASK"}, "Pulse Shaping Filter": T2, "Filter Parameter": f64, "Filter Length (symbols)": i32}
  T4 = cluster{"Training Sequence ": string, "Zero Pad Length": i32}
  T5 = cluster{"Synchronization Method": string, "Fixed Offset": i32, "Symbol Timing Recovery Method": string, "Frame Detection Method": string, "Correct Frequency Offset": bool}
  T6 = cluster{"Equalization Method": string, "Channel Estimate Length": i32, "Equalizer Length": i32, "Equalizer Delay": i32}
  T7 = cluster{"Noise Power (dB)": f64, "Channel Response": c128[], "Delay (sec)": f64, "Channel Model": string}
  T8 = cluster{"SNR(dB)": f64, "Channel Estimate": c128[], "Freq. Offset": f64, "Delay": f64}
  T9 = cluster{"FFT size (N)": i32, "Length of CP (Lc)": i32, "Null Tones": u32[], "Number of OFDM Symbols (derived)": i32, "Training Sequence FFT size": i32, "Training Sequence Length of CP": i32}
  T10 = cluster{"Device IP Address": string, "Active Antenna": string, "Carrier Frequency (Hz)": f64, "Gain (dB)": f64, "Generation Mode": enum{"Single Shot", "Simulate", "Continuous"}}
  T11 = cluster{"Device IP Address": string, "Active Antenna": string, "Carrier Frequency (Hz)": f64, "Gain (dB)": f64, "Trigger Level": f64, "Bandwidth (Hz)": f64, "Reference Position (%)": f64, "Capture Time (sec)": f64, "Simulate": bool}
  T12 = cluster{"Modulation Type": enum{"FSK", "PSK", "QAM", "MSK", "PAM", "ASK"}, "Pulse Shaping Filter": T2, "Filter Parameter": f64, "Filter Length (Symbols)": i32}
  T13 = cluster{"Modulation Type": string, "Pulse Shaping Parameters": T12, "TX Oversample Factor": i32, "Packet Length (Bits)": i32, "TX Sample Rate": f64, "Control Information For Packet Header/Tail": T4}
  T14 = cluster{"Training Sequence Type": string, "Training Sequence (derived)": c128[], "Zero Pad Length": i32}
  T15 = cluster{"Control Information\nfor Packet Header/Tail": T14, "RX Oversample Factor": i32, "Synchronization Options": T5, "Number of Data Symbols (Derived)": i32, "RX Sample Rate": f64, "Pulse Shaping Parameters": T12, "Channel Estimation/Equalization Parameters": T6, "Equalize Channel": bool, "Modulation Type": string}
  T16 = cluster{"Noise Power (dB)": f64, "Channel Response": c128[], "Frequency Offset": f64, "Delay (sec)": f64, "Channel Model": string}
diagram:
  Property Node(instance in=$"frequency values") -> ("First value"=w1, "Step"=w2, "Last value"=w3)
  while (iteration -> i1) {
    Multiply(w2, i1) -> w6
    Add(w1, w6) -> w7
    Property Node(instance in=$"TX Channel Model Parameters") -> ("Channel Response"=w8, "Noise Power (dB)"=w9, "Delay (sec)"=w10, "Channel Model"=w11)
    Property Node(instance in=T16 {all zero or empty}, "Frequency Offset"=w7, "Channel Response"=w8, "Noise Power (dB)"=w9, "Delay (sec)"=w10, "Channel Model"=w11) -> (instance out=w12)
    call "OFDM_simulator.gvi"(# of Iterations=$"# of Iterations", Pulse Shaping Parameters=$"Pulse Shaping Parameters", Packet Length (bits)=$"Packet Length (bits)", RX oversample factor=$"RX oversample factor", RX Sample Rate=$"RX Sample Rate", TX Sample Rate=$"TX Sample Rate", TX Oversample Factor=$"TX Oversample Factor", OFDM Parameters=$"OFDM Parameters", Equalize Channel=$"Equalize Channel", TX HW Parameters=$"TX HW Parameters", TX Modulation Parameters=$"TX Modulation Parameters", RX Modulation Parameters=$"RX Modulation Parameters", RX HW Parameters=$"RX HW Parameters", TX Channel Model Parameters=w12, Control Information For Packet Header/Tail=$"Control Information For Packet Header/Tail", Modulation Type=$"Modulation Type", Synchronization Options=$"Synchronization Options", Channel Estimation/Equalization Parameters=$"Channel Estimation/Equalization Parameters") -> (Average Bit-Error Rate=w13, Power Delay Profile=w14, error out=w15, I Data=w16, Q Data=w17, Measured Channel Impairements=w18, Received Constellation=w19, Received Eye Diagram=w20, Estimated Offset=w21, Error Statistic=w22)
    $"Average Bit-Error Rate" <- w13
    $"Error Statistic" <- w22
    $"Estimated Offset" <- w21
    $"Received Constellation" <- w19
    $"Received Eye Diagram" <- w20
    $"Power Delay Profile" <- w14
    Is Greater Or Equal(x=w7, y=w3) -> w23
    $"I Data" <- w16
    $"Q Data" <- w17
    Subtract(x=w1, y=w3) -> w24
    Absolute Value(x=w24) -> w25
    Divide(x=w6, y=w25) -> w26
    $Progress <- w26
    $"Measured Channel Impairements" <- w18
    $"error out" <- w15
    append w13 to w4
    append w7 to w5
    stop if w23
  }
  Build Cluster(w5, w4) -> w27
  $"BER vs frequency offset" <- w27
  $BER <- w4
