vi "OFDM_transmitter.gvi"   [LabVIEW NXG]
inputs:
  "error in": error
  "HW parameters In": T1 = {"Device IP Address"="192.168.10.3", "Active Antenna"="TX1", "Carrier Frequency (Hz)"=915000000, "Gain (dB)"=10, "Generation Mode"="Single Shot"}
  "Modulation Parameters In": T6 = {"Modulation Type"="QPSK", "Pulse Shaping Parameters"={"Modulation Type"="PSK", "Pulse Shaping Filter"="Root Raised Cos", "Filter Parameter"=0.5, "Filter Length (Symbols)"=8}, "TX Oversample Factor"=20, "Packet Length (Bits)"=500, "TX Sample Rate"=100, "Control Information For Packet Header/Tail"={"Training Sequence "="IEEE 802.11a Short", "Zero Pad Length"=8}}
  "Queues In": T7
  "OFDM Parameters In": T2 = {"FFT size (N)"=64, "Length of CP (Lc)"=8, "Null Tones"=[0, 30, 31, 32], "Number of OFDM Symbols (derived)"=1, "Training Sequence FFT size"=0, "Training Sequence Length of CP"=0}
  "Channel Model Parameters": T8 = {"Noise Power (dB)"=-Inf, "Channel Response"=[], "Frequency Offset"=0, "Delay (sec)"=0, "Channel Model"="AWGN"}
outputs:
  "error out": error
  "HW parameters Out": T1
  "Modulation Parameters Out": T6
  "OFDM Parameters Out": T2
  "Eye Diagram": cluster{"t0": f64, "dt": f64, "Y": f64[]}[]
  "Key Bit Sequence": u8[]
  "Number of Data Symbols": i32
  "Data Symbols": c128[]
  "Transmitted Constellation": T9[]
  "Output Complex Waveform": cluster{"t0": f64, "dt": f64, "Y": c128[]}
panel controls:
  "Plots": i32
panel indicators:
  "Actual Delay (sec)": f64
types:
  T1 = cluster{"Device IP Address": string, "Active Antenna": string, "Carrier Frequency (Hz)": f64, "Gain (dB)": f64, "Generation Mode": enum{"Single Shot", "Simulate", "Continuous"}}
  T2 = cluster{"FFT size (N)": i32, "Length of CP (Lc)": i32, "Null Tones": u32[], "Number of OFDM Symbols (derived)": i32, "Training Sequence FFT size": i32, "Training Sequence Length of CP": i32}
  T3 = enum{"none", "Raised Cosine", "Root Raised Cos", "Gaussian"}
  T4 = cluster{"Modulation Type": enum{"FSK", "PSK", "QAM", "MSK", "PAM", "ASK"}, "Pulse Shaping Filter": T3, "Filter Parameter": f64, "Filter Length (Symbols)": i32}
  T5 = cluster{"Training Sequence ": string, "Zero Pad Length": i32}
  T6 = cluster{"Modulation Type": string, "Pulse Shaping Parameters": T4, "TX Oversample Factor": i32, "Packet Length (Bits)": i32, "TX Sample Rate": f64, "Control Information For Packet Header/Tail": T5}
  T7 = cluster{"Key Bit Sequence Queue": Queue<u8[]>, "Training Sequence Queue": Queue<c128[]>}
  T8 = cluster{"Noise Power (dB)": f64, "Channel Response": c128[], "Frequency Offset": f64, "Delay (sec)": f64, "Channel Model": string}
  T9 = cluster{"constellation": f64[], "oversampled data": f64[]}
diagram:
  $"HW parameters Out" <- $"HW parameters In"
  case ($"error in") {
    frame No Error {
      # 1. Get symbol rate and determine number of data symbols
      call "transmitter_init (SubVI).gvi"(Modulation Parameters In=$"Modulation Parameters In") -> (symbol rate=w4, number of data symbols=w5)
      call "source.gviprotected"(Modulation Parameters In=$"Modulation Parameters In", error in (no error)=$"error in") -> (Modulation Parameters Out=w6, output bit stream=w7, error out=w8)
      call "modulate.gviprotected"(Error In=w8, Input Bit Stream=w7, Modulation Parameters In=w6) -> (Modulation Parameters Out=w9, Output Symbols=w10, Error Out=w11)
      call "OFDM_modulator.gviprotected"(Input Symbols=w10, OFDM Parameters In=$"OFDM Parameters In", error in (no error)=w11) -> (Output Symbols=w12, OFDM Parameters out=w3, error out=w13)
      call "OFDM_add_control.gviprotected"(Modulation Parameters In=w9, Input=w12, OFDM Parameters in=w3, error in (no error)=w13) -> (Modulation Parameters Out=w14, Output=w15, Training Symbols=w16, error out=w17)
      # place generated key bit sequence
      # and training sequence in their queues
      call "transmitter_enque (SubVI).gvi"(key bit stream=w7, training symbols=w16, Queues In=$"Queues In", error in=w17) -> (error out=w18)
      call "pulse_shaping.gviprotected"(Modulation Parameters In=w14, input=w15, error in (no error)=w18) -> (Modulation Parameters Out=w19, output=w20, error out=w21)
      Property Node(instance in=$"Modulation Parameters In") -> ("Pulse Shaping Parameters:Pulse Shaping Filter"=w22)
      # When the pulse shaping is a rectangle, add one element at the beginning
      # to have the same shift than with other filters (up to a multiple of the oversampling factor).
      # This enable to compare the maximum energy curves of the symbol timing block.
      case (w22) {
        frame "none" {
          Insert Into Array(inArray=w20, index0=0, new=0+0i) -> w23
        }
        frame "Raised Cosine", Default {
          w23 = w20
        }
      }
      call "transmitter_apply_channel (SubVI).gvi"(Channel Model Parameters=$"Channel Model Parameters", Input Waveform=w23, Modulation Parameters In=w19, error in=w21) -> (Modulation Parameters Out=w2, Output Complex Waveform=w24, Actual Delay (Sec)=w25, error out=w1)
      # symbol rate
      call "transmitter_generate_waveforms (SubVI).gvi"(complex waveform=w24, symbol rate (Hz)=w4, Y=w10) -> (transmitted constellation=w26, eye diagram=w27)
      # generate plots
      $"Transmitted Constellation" <- w26
      $"Eye Diagram" <- w27
      $"Number of Data Symbols" <- w5
      # data symbols
      # 3. Apply artificial channel to baseband signal
      $"Output Complex Waveform" <- w24
      # 1. Get symbol period and determine number of data symbols
      # 2. generate baseband signal from source bits
      # 3. Apply artificial channel to baseband signal
      # 2. generate baseband signal from source bits
      $"Data Symbols" <- w10
      $"Actual Delay (sec)" <- w25
      $"Key Bit Sequence" <- w7
    }
    frame Error {
      w1 = $"error in"
      w2 = $"Modulation Parameters In"
      w3 = $"OFDM Parameters In"
    }
  }
  $"OFDM Parameters Out" <- w3
  $"Modulation Parameters Out" <- w2
  $"error out" <- w1
