vi "RXRF_close (SubVI).gvi"   [LabVIEW NXG]
inputs:
  "HW Parameters In": T2 = {"Device IP Address"="192.168.10.2", "Active Antenna"="RX1", "Carrier Frequency (Hz)"=915000000, "Gain (dB)"=10, "Trigger Level"=0.01, "Bandwidth (Hz)"=39600000, "Reference Position (%)"=10, "Capture Time (sec)"=0.0005, "Simulate"=FALSE}
  "error in": error
  "Queues In": T1
  "USRP Session": niUSRP
outputs:
  "error out": error
types:
  T1 = cluster{"Element 1": Queue<u8[]>, "Element 2": Queue<c128[]>}
  T2 = cluster{"Device IP Address": string, "Active Antenna": string, "Carrier Frequency (Hz)": f64, "Gain (dB)": f64, "Trigger Level": f64, "Bandwidth (Hz)": f64, "Reference Position (%)": f64, "Capture Time (sec)": f64, "Simulate": bool}
diagram:
  Property Node(instance in=$"HW Parameters In") -> ("Simulate"=w1)
  case (w1) {
    frame False, Default {
      call "niUSRP Close Session.gvi"(Handle in=$"USRP Session", error in (no error)=$"error in") -> (Error Out=w2)
    }
    frame True {
      w2 = $"error in"
    }
  }
  Property Node(instance in=$"Queues In") -> ("Element 1"=w3, "Element 2"=w4)
  Release Queue(queue=w3) -> (error out=w5)
  Release Queue(queue=w4) -> (error out=w6)
  Merge Errors(w2, w5, w6) -> (error out=w7)
  $"error out" <- w7
