vi "frame_detect.gvi"   [LabVIEW NXG]
inputs:
  "Modulation Parameters": T6 = {"Control Information\nfor Packet Header/Tail"={"Training Sequence Type"="IEEE 802.11a Short", "Training Sequence (derived)"=[], "Zero Pad Length"=0}, "RX Oversample Factor"=20, "Synchronization Options"={"Synchronization Method"="Timing Estimation", "Fixed Offset"=0, "Symbol Timing Recovery Method"="Max Energy", "Frame Detection Method"="Sliding Correlator", "Correct Frequency Offset"=FALSE}, "Number of Data Symbols (Derived)"=100, "RX Sample Rate"=4000000, "Pulse Shaping Parameters"={"Modulation Type"="PSK", "Pulse Shaping Filter"="Root Raised Cos", "Filter Parameter"=0.5, "Filter Length (Symbols)"=8}, "Channel Estimation/Equalization Parameters"={"Equalization Method"="Direct", "Channel Estimate Length"=1, "Equalizer Length"=1, "Equalizer Delay"=-1}, "Equalize Channel"=FALSE, "Modulation Type"="QPSK"}
  "Input Complex Waveform": cluster{"t0": f64, "dt": f64, "Y": c128[]}
  "error in (no error)": error
outputs:
  "Output": c128[]
  "Frame Offset": i32
  "Frequency Offset": f64
  "error out": error
types:
  T1 = cluster{"Training Sequence Type": string, "Training Sequence (derived)": c128[], "Zero Pad Length": i32}
  T2 = cluster{"Synchronization Method": string, "Fixed Offset": i32, "Symbol Timing Recovery Method": string, "Frame Detection Method": string, "Correct Frequency Offset": bool}
  T3 = enum{"none", "Raised Cosine", "Root Raised Cos", "Gaussian"}
  T4 = cluster{"Modulation Type": enum{"FSK", "PSK", "QAM", "MSK", "PAM", "ASK"}, "Pulse Shaping Filter": T3, "Filter Parameter": f64, "Filter Length (Symbols)": i32}
  T5 = cluster{"Equalization Method": string, "Channel Estimate Length": i32, "Equalizer Length": i32, "Equalizer Delay": i32}
  T6 = cluster{"Control Information\nfor Packet Header/Tail": T1, "RX Oversample Factor": i32, "Synchronization Options": T2, "Number of Data Symbols (Derived)": i32, "RX Sample Rate": f64, "Pulse Shaping Parameters": T4, "Channel Estimation/Equalization Parameters": T5, "Equalize Channel": bool, "Modulation Type": string}
diagram:
  case ($"error in (no error)") {
    frame No Error {
      Property Node(instance in=$"Modulation Parameters") -> ("Synchronization Options:Frame Detection Method"=w2, "Control Information\nfor Packet Header/Tail:Training Sequence (derived)"=w3)
      # Apply appropriate frame detection + freq. offset correction algorithm
      case (w2) {
        frame "Sliding Correlator", Default {
          call "sliding_correlator.gviprotected"(Modulation Parameters=$"Modulation Parameters", Input Complex Waveform=$"Input Complex Waveform", error in (no error)=$"error in (no error)") -> (Output=w4, Frame Offset=w5, Frequency Offset=w6, error out=w1)
        }
        frame "Self Reference w/ Power Normalization" {
          call "self_reference_frame_synch.gviprotected"(Modulation Parameters=$"Modulation Parameters", Input Complex Waveform=$"Input Complex Waveform", error in (no error)=$"error in (no error)") -> (Output=w4, Frame Offset=w5, Frequency Offset=w6, error out=w1)
        }
        frame "Windowing" {
          Array Size(array=w3) -> (size(s)=w7)
          # Use training sequence length as window size.
          call "sliding_window.gviprotected"(Modulation Parameters=$"Modulation Parameters", Input Complex Waveform=$"Input Complex Waveform", Window Size=w7, error in (no error)=$"error in (no error)") -> (Output=w4, Frame Offset=w5, Frequency Offset=w6, error out=w1)
        }
      }
      $Output <- w4
      $"Frame Offset" <- w5
      $"Frequency Offset" <- w6
    }
    frame Error {
      w1 = $"error in (no error)"
    }
  }
  $"error out" <- w1
