vi "receiver_channel_impairments (SubVI).gvi"   [LabVIEW NXG]
inputs:
  "Modulation Parameters": T7 = {"Control Information\nfor Packet Header/Tail"={"Training Sequence Type"="IEEE 802.11a Short", "Training Sequence (derived)"=[], "Zero Pad Length"=0}, "RX Oversample Factor"=20, "Synchronization Options"={"Synchronization Method"="Timing Estimation", "Fixed Offset"=0, "Symbol Timing Recovery Method"="Max Energy", "Frame Detection Method"="Sliding Correlator", "Correct Frequency Offset"=FALSE}, "Number of Data Symbols (Derived)"=100, "RX Sample Rate"=4000000, "Pulse Shaping Parameters"={"Modulation Type"="PSK", "Pulse Shaping Filter"="Root Raised Cos", "Filter Parameter"=0.5, "Filter Length (Symbols)"=8}, "Channel Estimation/Equalization Parameters"={"Equalization Method"="Direct", "Channel Estimate Length"=1, "Equalizer Length"=1, "Equalizer Delay"=-1}, "Equalize Channel"=FALSE, "Modulation Type"="QPSK"}
  "mean-squared error": f64
  "channel estimate": c128[]
  "offset": i32
  "estimated frequency offset": f64
  "overhead offset": i32
outputs:
  "Measured channel impairements": T1
types:
  T1 = cluster{"SNR(dB)": f64, "channel estimate": c128[], "freq. offset": f64, "delay": f64}
  T2 = cluster{"Training Sequence Type": string, "Training Sequence (derived)": c128[], "Zero Pad Length": i32}
  T3 = cluster{"Synchronization Method": string, "Fixed Offset": i32, "Symbol Timing Recovery Method": string, "Frame Detection Method": string, "Correct Frequency Offset": bool}
  T4 = enum{"none", "Raised Cosine", "Root Raised Cos", "Gaussian"}
  T5 = cluster{"Modulation Type": enum{"FSK", "PSK", "QAM", "MSK", "PAM", "ASK"}, "Pulse Shaping Filter": T4, "Filter Parameter": f64, "Filter Length (Symbols)": i32}
  T6 = cluster{"Equalization Method": string, "Channel Estimate Length": i32, "Equalizer Length": i32, "Equalizer Delay": i32}
  T7 = cluster{"Control Information\nfor Packet Header/Tail": T2, "RX Oversample Factor": i32, "Synchronization Options": T3, "Number of Data Symbols (Derived)": i32, "RX Sample Rate": f64, "Pulse Shaping Parameters": T5, "Channel Estimation/Equalization Parameters": T6, "Equalize Channel": bool, "Modulation Type": string}
diagram:
  call "Estimate SNR.gvi"(Modulation Parameters=$"Modulation Parameters", mean-squared error=$"mean-squared error") -> (Estimated SNR (dB)=w1)
  Property Node(instance in=$"Modulation Parameters") -> ("RX Sample Rate"=w2)
  Subtract(x=$offset, y=$"overhead offset") -> w3
  Divide(x=w3, y=w2) -> w4
  Property Node(instance in=$"Measured channel impairements", "channel estimate"=$"channel estimate", "SNR(dB)"=w1, "freq. offset"=$"estimated frequency offset", "delay"=w4) -> (instance out=w5)
  $"Measured channel impairements" <- w5
