vi "receiver_generate_waveforms (SubVI).gvi"   [LabVIEW NXG]
inputs:
  "Modulation Parameters In": T9 = {"Control Information\nfor Packet Header/Tail"={"Training Sequence Type"="IEEE 802.11a Short", "Training Sequence (derived)"=[], "Zero Pad Length"=0}, "RX Oversample Factor"=20, "Synchronization Options"={"Synchronization Method"="Timing Estimation", "Fixed Offset"=0, "Symbol Timing Recovery Method"="Max Energy", "Frame Detection Method"="Sliding Correlator", "Correct Frequency Offset"=FALSE}, "Number of Data Symbols (Derived)"=100, "RX Sample Rate"=4000000, "Pulse Shaping Parameters"={"Modulation Type"="PSK", "Pulse Shaping Filter"="Root Raised Cos", "Filter Parameter"=0.5, "Filter Length (Symbols)"=8}, "Channel Estimation/Equalization Parameters"={"Equalization Method"="Direct", "Channel Estimate Length"=1, "Equalizer Length"=1, "Equalizer Delay"=-1}, "Equalize Channel"=FALSE, "Modulation Type"="QPSK"}
  "Intermediate Complex Waveform": cluster{"t0": f64, "dt": f64, "Y": c128[]} = {"t0"=0, "dt"=1, "Y"=[]}
  "Data Symbols": c128[]
  "OFDM Parameters In": T10 = {"FFT size (N)"=64, "Length of CP (Lc)"=8, "Null Tones"=[0, 30, 31, 32], "Number of OFDM Symbols (derived)"=1, "Training Sequence FFT size"=0, "Training Sequence Length of CP"=0}
  "Measured Channel Impairements": T1
  "FD Channel Estimate": c128[]
outputs:
  "Modulation Parameters Out": T9
  "RX Waveforms Out": T2
panel controls:
  "I/Q (I)": enum{"I", "Q"} = "I"
  "Eye Length": i32 = 2
  "Tab": i32
panel indicators:
  "Power Delay Profile": waveform<f64>
  "Received Constellation": T3[]
  "Eye Diagram": cluster{"t0": f64, "dt": f64, "Y": f64[]}[]
types:
  T1 = cluster{"SNR(dB)": f64, "channel estimate": c128[], "freq. offset": f64, "delay": f64}
  T2 = cluster{"IQ Graph": cluster{"Element 1": f64[], "Element 2": f64[]}[], "Eye Diagram": cluster{"t0": f64, "dt": f64, "Y": f64[]}[], "Power Delay Profile": DoubleAnalogWaveform, "Magnitude Response": cluster{"Element 1": f64, "Element 2": f64}[]}
  T3 = cluster{"constellation": f64[], "oversampled data": f64[]}
  T4 = cluster{"Training Sequence Type": string, "Training Sequence (derived)": c128[], "Zero Pad Length": i32}
  T5 = cluster{"Synchronization Method": string, "Fixed Offset": i32, "Symbol Timing Recovery Method": string, "Frame Detection Method": string, "Correct Frequency Offset": bool}
  T6 = enum{"none", "Raised Cosine", "Root Raised Cos", "Gaussian"}
  T7 = cluster{"Modulation Type": enum{"FSK", "PSK", "QAM", "MSK", "PAM", "ASK"}, "Pulse Shaping Filter": T6, "Filter Parameter": f64, "Filter Length (Symbols)": i32}
  T8 = cluster{"Equalization Method": string, "Channel Estimate Length": i32, "Equalizer Length": i32, "Equalizer Delay": i32}
  T9 = cluster{"Control Information\nfor Packet Header/Tail": T4, "RX Oversample Factor": i32, "Synchronization Options": T5, "Number of Data Symbols (Derived)": i32, "RX Sample Rate": f64, "Pulse Shaping Parameters": T7, "Channel Estimation/Equalization Parameters": T8, "Equalize Channel": bool, "Modulation Type": string}
  T10 = cluster{"FFT size (N)": i32, "Length of CP (Lc)": i32, "Null Tones": u32[], "Number of OFDM Symbols (derived)": i32, "Training Sequence FFT size": i32, "Training Sequence Length of CP": i32}
diagram:
  Property Node(instance in=$"Modulation Parameters In") -> ("RX Sample Rate"=w1, "RX Oversample Factor"=w2)
  Divide(x=w1, y=w2) -> w3
  Reciprocal(x=w3) -> w4
  call "make_MTwaveform.gvi"(dt=w4, Y=$"Data Symbols") -> (Output MT Waveform=w5)
  call "MT Format Constellation.gvi"(waveform=w5) -> (constellation graph=w6)
  $"Received Constellation" <- w6
  call "OFDM_plot_channel.gviprotected"(FD Channel Estimate=$"FD Channel Estimate", Symbol Period=w4, OFDM Parameters In=$"OFDM Parameters In") -> (Magnitude Response=w7)
  call "MT Format Eye Diagram (complex).gvi"(waveform=$"Intermediate Complex Waveform", symbol rate=w3, eye length=$"Eye Length", I/Q=$"I/Q (I)") -> (eye diagram=w8)
  Property Node(instance in=$"Measured Channel Impairements") -> ("channel estimate"=w9)
  call "Upsample (CDB).gvi"(x=w9, upsampling factor=w2) -> (upsampled array=w10)
  # w3: symbol rate
  Reciprocal(x=w1) -> w11
  call "make_MTwaveform.gvi"(dt=w11, Y=w10) -> (Output MT Waveform=w12)
  call "MT Get Complex IQ Component.gvi"(IQ data in=w12, component choice="Magnitude") -> (CE component=w13)
  Property Node(instance in=w13) -> ("Y"=w14, "t0"=w15, "dt"=w16)
  Square(x=w14) -> w17
  Build Waveform Node(Y=w17, dt=w16, t0=w15) -> (output waveform=w18)
  Property Node(instance in=$"RX Waveforms Out", "IQ Graph"=w6, "Eye Diagram"=w8, "Power Delay Profile"=w18, "Magnitude Response"=w7) -> (instance out=w19)
  $"RX Waveforms Out" <- w19
  $"Modulation Parameters Out" <- $"Modulation Parameters In"
  $"Eye Diagram" <- w8
  $"Power Delay Profile" <- w18
