vi "receiver_init (SubVI).gvi"   [LabVIEW NXG]
inputs:
  "Modulation Parameters In": T7 = {"Control Information\nfor Packet Header/Tail"={"Training Sequence Type"="IEEE 802.11a Short", "Training Sequence (derived)"=[], "Zero Pad Length"=0}, "RX Oversample Factor"=20, "Synchronization Options"={"Synchronization Method"="Timing Estimation", "Fixed Offset"=0, "Symbol Timing Recovery Method"="Max Energy", "Frame Detection Method"="Sliding Correlator", "Correct Frequency Offset"=FALSE}, "Number of Data Symbols (Derived)"=100, "RX Sample Rate"=4000000, "Pulse Shaping Parameters"={"Modulation Type"="PSK", "Pulse Shaping Filter"="Root Raised Cos", "Filter Parameter"=0.5, "Filter Length (Symbols)"=8}, "Channel Estimation/Equalization Parameters"={"Equalization Method"="Direct", "Channel Estimate Length"=1, "Equalizer Length"=1, "Equalizer Delay"=-1}, "Equalize Channel"=FALSE, "Modulation Type"="QPSK"}
  "Queues In": T1
  "OFDM Parameters In": T8 = {"FFT size (N)"=64, "Length of CP (Lc)"=8, "Null Tones"=[0, 30, 31, 32], "Number of OFDM Symbols (derived)"=1, "Training Sequence FFT size"=0, "Training Sequence Length of CP"=0}
  "Error In": error
outputs:
  "Modulation Parameters Out": T7
  "Queues Out": T1
  "Symbol Rate": f64
  "Key Bit Sequence": u8[]
  "overhead offset": i32
  "OFDM Parameters Out": T8
  "Error Out": error
types:
  T1 = cluster{"Key Bit Sequence Queue": Queue<u8[]>, "Training Sequence Queue": Queue<c128[]>}
  T2 = cluster{"Training Sequence Type": string, "Training Sequence (derived)": c128[], "Zero Pad Length": i32}
  T3 = cluster{"Synchronization Method": string, "Fixed Offset": i32, "Symbol Timing Recovery Method": string, "Frame Detection Method": string, "Correct Frequency Offset": bool}
  T4 = enum{"none", "Raised Cosine", "Root Raised Cos", "Gaussian"}
  T5 = cluster{"Modulation Type": enum{"FSK", "PSK", "QAM", "MSK", "PAM", "ASK"}, "Pulse Shaping Filter": T4, "Filter Parameter": f64, "Filter Length (Symbols)": i32}
  T6 = cluster{"Equalization Method": string, "Channel Estimate Length": i32, "Equalizer Length": i32, "Equalizer Delay": i32}
  T7 = cluster{"Control Information\nfor Packet Header/Tail": T2, "RX Oversample Factor": i32, "Synchronization Options": T3, "Number of Data Symbols (Derived)": i32, "RX Sample Rate": f64, "Pulse Shaping Parameters": T5, "Channel Estimation/Equalization Parameters": T6, "Equalize Channel": bool, "Modulation Type": string}
  T8 = cluster{"FFT size (N)": i32, "Length of CP (Lc)": i32, "Null Tones": u32[], "Number of OFDM Symbols (derived)": i32, "Training Sequence FFT size": i32, "Training Sequence Length of CP": i32}
diagram:
  $"Queues Out" <- $"Queues In"
  Property Node(instance in=$"Queues In") -> ("Key Bit Sequence Queue"=w1, "Training Sequence Queue"=w2)
  Preview Queue Element(queue=w2, timeout in ms (-1)=100) -> (element=w3, error out=w4)
  Property Node(instance in=$"Modulation Parameters In") -> ("Modulation Type"=w5, "RX Sample Rate"=w6, "RX Oversample Factor"=w7)
  Preview Queue Element(error in (no error)=w4, queue=w1, timeout in ms (-1)=100) -> (element=w8)
  Array Size(array=w8) -> (size(s)=w9)
  case (w5) {
    frame "BPSK", Default {
      w10 = w9
    }
    frame "QPSK" {
      Quotient And Remainder(x=w9, y=2) -> (floor(x/y)=w10)
    }
  }
  Property Node(instance in=$"Modulation Parameters In", "Control Information\nfor Packet Header/Tail:Training Sequence (derived)"=w3, "Number of Data Symbols (Derived)"=w10) -> (instance out=w11)
  $"Modulation Parameters Out" <- w11
  $"Key Bit Sequence" <- w8
  Divide(x=w6, y=w7) -> w12
  $"Symbol Rate" <- w12
  Property Node(instance in=$"OFDM Parameters In") -> (instance out=w13, "FFT size (N)"=w14, "Null Tones"=w15)
  Array Size(array=w15) -> (size(s)=w16)
  Subtract(x=w14, y=w16) -> w17
  Divide(x=w10, y=w17) -> w18
  Round Toward Positive Infinity(x=w18) -> w19
  To Long Integer(number=w19) -> w20
  Property Node(instance in=w13, "Number of OFDM Symbols (derived)"=w20) -> (instance out=w21)
  $"OFDM Parameters Out" <- w21
  Property Node(instance in=$"Modulation Parameters In") -> ("Pulse Shaping Parameters:Pulse Shaping Filter"=w22, "Pulse Shaping Parameters:Filter Length (Symbols)"=w23, "RX Oversample Factor"=w24)
  call "Compute overhead offset.gvi"(Pulse Shaping Parameters:Filter Length (Symbols)=w23, RX Oversample Factor=w24, Pulse Shaping Parameters:Pulse Shaping Filter=w22) -> (overhead offset=w25)
  $"overhead offset" <- w25
  $"Error Out" <- $"Error In"
