vi "student_OFDM_demodulator.gvi"   [LabVIEW NXG]
inputs:
  "Modulation Parameters In": T7 = {"Control Information\nfor Packet Header/Tail"={"Training Sequence Type"="IEEE 802.11a Short", "Training Sequence (derived)"=[], "Zero Pad Length"=0}, "RX Oversample Factor"=20, "Synchronization Options"={"Synchronization Method"="Timing Estimation", "Fixed Offset"=0, "Symbol Timing Recovery Method"="Max Energy", "Frame Detection Method"="Sliding Correlator", "Correct Frequency Offset"=FALSE}, "Number of Data Symbols (Derived)"=100, "RX Sample Rate"=4000000, "Pulse Shaping Parameters"={"Modulation Type"="PSK", "Pulse Shaping Filter"="Root Raised Cos", "Filter Parameter"=0.5, "Filter Length (Symbols)"=8}, "Channel Estimation/Equalization Parameters"={"Equalization Method"="Direct", "Channel Estimate Length"=1, "Equalizer Length"=1, "Equalizer Delay"=-1}, "Equalize Channel"=FALSE, "Modulation Type"="QPSK"}
  "Received Samples": c128[]
  "OFDM Parameters in": T1 = {"FFT size (N)"=64, "Length of CP (Lc)"=8, "Null Tones"=[0, 30, 31, 32], "Number of OFDM Symbols (derived)"=1, "Training Sequence FFT size"=0, "Training Sequence Length of CP"=0}
  "channel estimate": c128[]
  "error in (no error)": error
outputs:
  "Modulation Parameters Out": T7
  "Demodulated Symbols": c128[]
  "OFDM Parameters Out": T1
  "error out": error
  "FD channel estimate": c128[]
types:
  T1 = cluster{"FFT size (N)": i32, "Length of CP (Lc)": i32, "Null Tones": u32[], "Number of OFDM Symbols (derived)": i32, "Training Sequence FFT size": i32, "Training Sequence Length of CP": i32}
  T2 = cluster{"Training Sequence Type": string, "Training Sequence (derived)": c128[], "Zero Pad Length": i32}
  T3 = cluster{"Synchronization Method": string, "Fixed Offset": i32, "Symbol Timing Recovery Method": string, "Frame Detection Method": string, "Correct Frequency Offset": bool}
  T4 = enum{"none", "Raised Cosine", "Root Raised Cos", "Gaussian"}
  T5 = cluster{"Modulation Type": enum{"FSK", "PSK", "QAM", "MSK", "PAM", "ASK"}, "Pulse Shaping Filter": T4, "Filter Parameter": f64, "Filter Length (Symbols)": i32}
  T6 = cluster{"Equalization Method": string, "Channel Estimate Length": i32, "Equalizer Length": i32, "Equalizer Delay": i32}
  T7 = cluster{"Control Information\nfor Packet Header/Tail": T2, "RX Oversample Factor": i32, "Synchronization Options": T3, "Number of Data Symbols (Derived)": i32, "RX Sample Rate": f64, "Pulse Shaping Parameters": T5, "Channel Estimation/Equalization Parameters": T6, "Equalize Channel": bool, "Modulation Type": string}
diagram:
  Property Node(instance in=$"Modulation Parameters In") -> (instance out=w1, "Number of Data Symbols (Derived)"=w2, "Equalize Channel"=w3)
  $"Modulation Parameters Out" <- w1
  Property Node(instance in=$"OFDM Parameters in") -> (instance out=w4, "Null Tones"=w5, "FFT size (N)"=w6, "Length of CP (Lc)"=w7)
  $"OFDM Parameters Out" <- w4
  Add(w6, w7) -> w8
  call "S2P.gviprotected"(Serial Input=$"Received Samples", Block Size=w8, error in (no error)=$"error in (no error)") -> (Parallel Output=w9, error out=w10)
  call "OFDM_remove_CP.gviprotected"(Input=w9, Length of CP (Lc)=w7) -> (Output=w11)
  # COMPLETE HERE
  # Useful blocks:
  for {
    w12 = each element of w11
    call "Complex FFT.gvi"(x=w12, FFT size=w6) -> (FFT {x}=w14)
    Square Root(x=w6) -> w15
    Divide(x=w14, y=w15) -> w16
    append w16 to w13
  }
  call "student_OFDM_FEQ.gvi"(Modulation Parameters In=w1, OFDM Parameters in=w4, input=w13, channel estimate=$"channel estimate", error in (no error)=w10) -> (equalized output=w17, FD channel estimate=w18, error out=w19)
  Select(s=w3, t=w17, f=w13) -> w20
  call "OFDM_remove_null_tones.gviprotected"(Input=w20, Null Tones=w5, error in (no error)=w19) -> (Output=w21, error out=w22)
  call "P2S.gviprotected"(Parallel Input=w21, error in (no error)=w22) -> (Serial Output=w23, error out=w24)
  Array Subset(array=w23, length0=w2) -> w25
  $"Demodulated Symbols" <- w25
  $"error out" <- w24
  $"FD channel estimate" <- w18
  call "OFDM_FEQ.gviprotected"()
