vi "student_OFDM_modulator.gvi"   [LabVIEW NXG]
inputs:
  "Input Symbols": c128[]
  "OFDM Parameters In": T1 = {"FFT size (N)"=64, "Length of CP (Lc)"=8, "Null Tones"=[0, 30, 31, 32], "Number of OFDM Symbols (derived)"=1, "Training Sequence FFT size"=0, "Training Sequence Length of CP"=0}
  "error in (no error)": error
outputs:
  "Output Symbols": c128[]
  "OFDM Parameters out": T1
  "error out": error
types:
  T1 = cluster{"FFT size (N)": i32, "Length of CP (Lc)": i32, "Null Tones": u32[], "Number of OFDM Symbols (derived)": i32, "Training Sequence FFT size": i32, "Training Sequence Length of CP": i32}
diagram:
  $"OFDM Parameters out" <- $"OFDM Parameters In"
  Property Node(instance in=$"OFDM Parameters In") -> ("Null Tones"=w1, "FFT size (N)"=w2, "Length of CP (Lc)"=w3)
  # COMPLETE HERE
  Array Size(array=w1) -> (size(s)=w4)
  Subtract(x=w2, y=w4) -> w5
  # Useful blocks:
  call "S2P.gviprotected"(Serial Input=$"Input Symbols", Block Size=w5, error in (no error)=$"error in (no error)") -> (Parallel Output=w6, error out=w7)
  call "OFDM_insert_null_tones.gviprotected"(Input=w6, Null Tones=w1) -> (Output=w8)
  for {
    w9 = each element of w8
    call "Inverse Complex FFT.gvi"(FFT {x}=w9) -> (x=w11)
    Square Root(x=w2) -> w12
    Multiply(w11, w12) -> w13
    append w13 to w10
  }
  call "OFDM_add_CP.gviprotected"(Input=w10, Length of CP (Lc)=w3) -> (Output=w14)
  call "P2S.gviprotected"(Parallel Input=w14, error in (no error)=w7) -> (Serial Output=w15, error out=w16)
  $"Output Symbols" <- w15
  $"error out" <- w16
