vi "top_ofdm_tx.gvi"   [LabVIEW NXG]
inputs:
  "HW Parameters": T7 = {"Device IP Address"="192.168.10.3", "Active Antenna"="TX1", "Carrier Frequency (Hz)"=915000000, "Gain (dB)"=10, "Generation Mode"="Continuous"}
  "Modulation Parameters": T5 = {"Modulation Type"="QPSK", "Pulse Shaping Parameters"={"Modulation Type"="PSK", "Pulse Shaping Filter"="Raised Cosine", "Filter Parameter"=0.5, "Filter Length (Symbols)"=8}, "TX Oversample Factor"=200, "Packet Length (Bits)"=500, "TX Sample Rate"=20000000, "Control Information For Packet Header/Tail"={"Training Sequence "="Length 11 Barker Sequence", "Zero Pad Length"=8}}
  "Channel Model Parameters": T8 = {"Noise Power (dB)"=-Inf, "Channel Response"=[], "Frequency Offset"=0, "Delay (sec)"=0, "Channel Model"="AWGN"}
  "OFDM Parameters": T1 = {"FFT size (N)"=64, "Length of CP (Lc)"=8, "Null Tones"=[0, 30, 31, 32], "Number of OFDM Symbols (derived)"=1, "Training Sequence FFT size"=64, "Training Sequence Length of CP"=8}
  "error in": error
outputs:
  "error out": error
  "Packet Duration (sec)": f64
  "Output IQ Waveform": cluster{"t0": f64, "dt": f64, "Y": c128[]}
  "Transmitting": bool
  "Queues Out": T9
panel controls:
  "Stop": bool
  "Plots": i32
  "Parameters": i32
panel indicators:
  "Symbol Rate (Hz)": f64
  "Key Bit Sequence": u8[]
  "Data Symbols": c128[]
  "Coerced Carrier Frequency (Hz)": f64
  "Coerced Gain (dB)": f64
  "Eye Diagram": cluster{"t0": f64, "dt": f64, "Y": f64[]}[]
  "Transmitted Constellation": T6[]
types:
  T1 = cluster{"FFT size (N)": i32, "Length of CP (Lc)": i32, "Null Tones": u32[], "Number of OFDM Symbols (derived)": i32, "Training Sequence FFT size": i32, "Training Sequence Length of CP": i32}
  T2 = enum{"none", "Raised Cosine", "Root Raised Cos", "Gaussian"}
  T3 = cluster{"Modulation Type": enum{"FSK", "PSK", "QAM", "MSK", "PAM", "ASK"}, "Pulse Shaping Filter": T2, "Filter Parameter": f64, "Filter Length (Symbols)": i32}
  T4 = cluster{"Training Sequence ": string, "Zero Pad Length": i32}
  T5 = cluster{"Modulation Type": string, "Pulse Shaping Parameters": T3, "TX Oversample Factor": i32, "Packet Length (Bits)": i32, "TX Sample Rate": f64, "Control Information For Packet Header/Tail": T4}
  T6 = cluster{"constellation": f64[], "oversampled data": f64[]}
  T7 = cluster{"Device IP Address": string, "Active Antenna": string, "Carrier Frequency (Hz)": f64, "Gain (dB)": f64, "Generation Mode": enum{"Single Shot", "Simulate", "Continuous"}}
  T8 = cluster{"Noise Power (dB)": f64, "Channel Response": c128[], "Frequency Offset": f64, "Delay (sec)": f64, "Channel Model": string}
  T9 = cluster{"Key Bit Sequence Queue": Queue<u8[]>, "Training Sequence Queue": Queue<c128[]>}
diagram:
  case ($"error in") {
    frame No Error {
      call "TXRF_init.gvi"(HW Parameters In=$"HW Parameters", Modulation Parameters In=$"Modulation Parameters", error in=$"error in") -> (error out=w3, HW Parameters Out=w4, Modulation Parameters Out=w5, Queues Out=w6, Coerced Carrier Frequency (Hz)=w7, Coerced Gain (dB)=w8, USRP Session out=w9)
      call "OFDM_transmitter.gvi"(error in=w3, HW parameters In=w4, Modulation Parameters In=w5, Queues In=w6, OFDM Parameters In=$"OFDM Parameters", Channel Model Parameters=$"Channel Model Parameters") -> (error out=w10, HW parameters Out=w11, Modulation Parameters Out=w12, OFDM Parameters Out=w13, Eye Diagram=w14, Key Bit Sequence=w15, Data Symbols=w16, Transmitted Constellation=w17, Output Complex Waveform=w18)
      Property Node(instance in=w11) -> ("Generation Mode"=w19)
      case (w19) {
        frame "Single Shot" {
          call "TXRF_prepare_for_transmit.gvi"(IQ Data=w18, error in=w10) -> (Scaled and Padded IQ Data=w20, error out=w21)
          call "TXRF_send.gvi"(USRP Session in=w9, error in=w21, IQ Data in=w20, HW Parameters In=w11) -> (error out=w22, USRP Session out=w23)
          call "niUSRP Close Session.gvi"(Handle in=w23, error in (no error)=w22) -> (Error Out=w1)
        }
        frame "Simulate" {
          w1 = w10
        }
        frame "Continuous", Default {
          call "TXRF_prepare_for_transmit.gvi"(IQ Data=w18, error in=w10) -> (Scaled and Padded IQ Data=w24, error out=w25)
          while {
            Not(x=TRUE) -> w26
            $Transmitting <- TRUE
            call "TXRF_send.gvi"(USRP Session in=w9, error in=w25, IQ Data in=w24, end of data?=TRUE, HW Parameters In=w11) -> (error out=w27, USRP Session out=w28)
            Property Node(instance in=w27) -> ("status"=w29)
            Logical Or(w29, $Stop) -> w30
            stop if w30
          }
          $Transmitting <- w26
          call "niUSRP Close Session.gvi"(Handle in=w28, error in (no error)=w27) -> (Error Out=w1)
        }
      }
      $"Queues Out" <- w6
      $"Eye Diagram" <- w14
      $"Key Bit Sequence" <- w15
      $"Output IQ Waveform" <- w18
      $"Transmitted Constellation" <- w17
      $"OFDM Parameters" <- w13
      $"Data Symbols" <- w16
      $"Coerced Carrier Frequency (Hz)" <- w7
      $"Coerced Gain (dB)" <- w8
      Property Node(instance in=w12) -> ("TX Oversample Factor"=w31, "TX Sample Rate"=w32)
      Property Node(instance in=w18) -> ("Y"=w33)
      Array Size(array=w33) -> (size(s)=w34)
      Divide(x=w34, y=w32) -> w35
      $"Packet Duration (sec)" <- w35
      Divide(x=w32, y=w31) -> w36
      $"Symbol Rate (Hz)" <- w36
      w2 = FALSE
    }
    frame Error {
      w1 = $"error in"
      w2 = FALSE
    }
  }
  $"error out" <- w1
  $Stop <- w2
