vi "TXRF_init.gvi"   [LabVIEW NXG]
inputs:
  "HW Parameters In": T2 = {"Device IP Address"="192.168.11.2", "Active Antenna"="TX1", "Carrier Frequency (Hz)"=915000000, "Gain (dB)"=10, "Generation Mode"="Single Shot"}
  "Modulation Parameters In": T6 = {"Modulation Type"="QPSK", "Pulse Shaping Parameters"={"Modulation Type"="PSK", "Pulse Shaping Filter"="Root Raised Cos", "Filter Parameter"=0.5, "Filter Length (Symbols)"=8}, "TX Oversample Factor"=20, "Packet Length (Bits)"=500, "TX Sample Rate"=100, "Control Information For Packet Header/Tail"={"Training Sequence "="IEEE 802.11a Short", "Zero Pad Length"=8}}
  "error in": error
outputs:
  "error out": error
  "HW Parameters Out": T2
  "Modulation Parameters Out": T6
  "Queues Out": T1
  "Coerced Carrier Frequency (Hz)": f64
  "Coerced Gain (dB)": f64
  "USRP Session out": niUSRP
types:
  T1 = cluster{"Element 1": Queue<u8[]>, "Element 2": Queue<c128[]>}
  T2 = cluster{"Device IP Address": string, "Active Antenna": string, "Carrier Frequency (Hz)": f64, "Gain (dB)": f64, "Generation Mode": enum{"Single Shot", "Simulate", "Continuous"}}
  T3 = enum{"none", "Raised Cosine", "Root Raised Cos", "Gaussian"}
  T4 = cluster{"Modulation Type": enum{"FSK", "PSK", "QAM", "MSK", "PAM", "ASK"}, "Pulse Shaping Filter": T3, "Filter Parameter": f64, "Filter Length (Symbols)": i32}
  T5 = cluster{"Training Sequence ": string, "Zero Pad Length": i32}
  T6 = cluster{"Modulation Type": string, "Pulse Shaping Parameters": T4, "TX Oversample Factor": i32, "Packet Length (Bits)": i32, "TX Sample Rate": f64, "Control Information For Packet Header/Tail": T5}
diagram:
  $"Modulation Parameters Out" <- $"Modulation Parameters In"
  $"HW Parameters Out" <- $"HW Parameters In"
  case ($"error in") {
    frame No Error {
      Obtain Queue(element data type=u8[] [], name (unnamed)="Key Bit Sequence Queue") -> (queue out=w2)
      Obtain Queue(element data type=c128[] [], name (unnamed)="Training Sequence Queue") -> (queue out=w3)
      Build Cluster(w2, w3) -> w4
      $"Queues Out" <- w4
      Property Node(instance in=$"HW Parameters In") -> ("Generation Mode"=w5)
      case (w5) {
        frame "Simulate", Default {
          w1 = $"error in"
        }
        frame "Single Shot", "Continuous" {
          Property Node(instance in=$"Modulation Parameters In") -> ("TX Sample Rate"=w6)
          Property Node(instance in=$"HW Parameters In") -> ("Device IP Address"=w7, "Active Antenna"=w8, "Carrier Frequency (Hz)"=w9, "Gain (dB)"=w10)
          call "niUSRP Open Tx Session.gvi"(Device names=w7, error in (no error)=$"error in") -> (Error Out=w11, Session handle=w12)
          call "niUSRP Configure Signal.gvi"(session handle=w12, IQ rate=w6, carrier frequency=w9, gain=w10, error in (no error)=w11, active antenna=w8) -> (session handle out=w13, coerced carrier frequency=w14, coerced gain=w15, Error Out=w16)
          $"Coerced Carrier Frequency (Hz)" <- w14
          $"Coerced Gain (dB)" <- w15
          call "niUSRP Commit.gvi"(session handle=w13, error in (no error)=w16) -> (session handle out=w17, Error Out=w1)
          $"USRP Session out" <- w17
        }
      }
    }
    frame Error {
      w1 = $"error in"
    }
  }
  $"error out" <- w1
