vi "frame_detect.gvi"   [LabVIEW NXG]
inputs:
  "Modulation Parameters In": T7 = {"Modulation Type"="QPSK", "Control Information\nfor Packet Header/Tail"={"Training Sequence (derived)"=[], "Zero Pad Length"=0}, "RX Oversample Factor"=20, "Synchronization Options"={"Synchronization Method"="Timing Estimation", "Fixed Offset"=0, "Symbol Timing Recovery Method"="Max Energy", "Frame Detection Method"="Sliding Correlator", "Frequency Estimation Method"="", "Correct Frequency Offset"=FALSE, "Correct Symbol Timing"=FALSE}, "Number of Data Symbols (Derived)"=100, "RX Sample Rate"=4000000, "Pulse Shaping Parameters"={"Modulation Type"="PSK", "Pulse Shaping Filter"="Root Raised Cos", "Filter Parameter"=0.5, "Filter Length (Symbols)"=8}, "Channel Estimation/Equalization Parameters"={"Equalization Method"="Direct", "Channel Estimate Length"=1, "Equalizer Length"=1, "Equalizer Delay"=-1, "Equalize"=FALSE}}
  "Input Complex Waveform": cluster{"t0": f64, "dt": f64, "Y": c128[]}
  "TX Channel Model Parameters": T1 = {"Noise Power (dB)"=-Inf, "Channel Response"=[], "Frequency Offset"=0, "Delay (sec)"=0, "Channel Model"="AWGN"}
  "error in (no error)": error
  "Alignment Offset": f64
outputs:
  "Output": c128[]
  "Frame Offset": i32
  "Frequency Offset": f64
  "error out": error
types:
  T1 = cluster{"Noise Power (dB)": f64, "Channel Response": c128[], "Frequency Offset": f64, "Delay (sec)": f64, "Channel Model": string}
  T2 = cluster{"Training Sequence (derived)": c128[], "Zero Pad Length": i32}
  T3 = cluster{"Synchronization Method": string, "Fixed Offset": i32, "Symbol Timing Recovery Method": string, "Frame Detection Method": string, "Frequency Estimation Method": string, "Correct Frequency Offset": bool, "Correct Symbol Timing": bool}
  T4 = enum{"none", "Raised Cosine", "Root Raised Cos", "Gaussian"}
  T5 = cluster{"Modulation Type": enum{"FSK", "PSK", "QAM", "MSK", "PAM", "ASK"}, "Pulse Shaping Filter": T4, "Filter Parameter": f64, "Filter Length (Symbols)": i32}
  T6 = cluster{"Equalization Method": string, "Channel Estimate Length": i32, "Equalizer Length": i32, "Equalizer Delay": i32, "Equalize": bool}
  T7 = cluster{"Modulation Type": string, "Control Information\nfor Packet Header/Tail": T2, "RX Oversample Factor": i32, "Synchronization Options": T3, "Number of Data Symbols (Derived)": i32, "RX Sample Rate": f64, "Pulse Shaping Parameters": T5, "Channel Estimation/Equalization Parameters": T6}
diagram:
  case ($"error in (no error)") {
    frame No Error {
      Property Node(instance in=$"Modulation Parameters In") -> (instance out=w2, "Synchronization Options:Frame Detection Method"=w3, "Control Information\nfor Packet Header/Tail:Training Sequence (derived)"=w4, "Synchronization Options:Correct Symbol Timing"=w5)
      case (w5) {
        frame False, Default {
          w6 = 0
        }
        frame True {
          w6 = $"Alignment Offset"
        }
      }
      # Apply appropriate frame detection + freq. offset correction algorithm
      case (w3) {
        frame "Sliding Correlator", Default {
          call "student_sliding_correlator.gvi"(Modulation Parameters=w2, Input Complex Waveform=$"Input Complex Waveform", error in (no error)=$"error in (no error)") -> (Output=w7, Frame Offset=w8, Frequency Offset=w9, error out=w1)
          call "sliding_correlator.gviprotected"(Modulation Parameters In=w2, Input Complex Waveform=$"Input Complex Waveform", TX Channel Model Parameters=$"TX Channel Model Parameters", error in (no error)=$"error in (no error)")
        }
        frame "Self Reference w/ Power Normalization" {
          call "self_reference_frame_synch.gvi"(Modulation Parameters In=w2, Input Complex Waveform=$"Input Complex Waveform", TX Channel Model Parameters=$"TX Channel Model Parameters", error in (no error)=$"error in (no error)") -> (Output=w7, Frame Offset=w8, Frequency Offset=w9, error out=w1)
        }
        frame "Windowing" {
          Array Size(array=w4) -> (size(s)=w10)
          # Use training sequence length as window size.
          call "sliding_window.gvi"(Modulation Parameters In=w2, Input Complex Waveform=$"Input Complex Waveform", TX Channel Model Parameters=$"TX Channel Model Parameters", Window Size=w10, error in (no error)=$"error in (no error)") -> (Output=w7, Frame Offset=w8, Frequency Offset=w9, error out=w1)
        }
        frame "Ideal alignment" {
          call "Ideal frame alignment.gvi"(Modulation Parameters In=w2, Input Complex Waveform=$"Input Complex Waveform", TX Channel Model Parameters=$"TX Channel Model Parameters", Alignment Offset=w6) -> (Output=w7, Frame Alignment Offset=w8, Frequency Offset=w9)
          w1 = $"error in (no error)"
        }
      }
      $Output <- w7
      $"Frame Offset" <- w8
      $"Frequency Offset" <- w9
    }
    frame Error {
      w1 = $"error in (no error)"
    }
  }
  $"error out" <- w1
