vi "transmitter.gvi"   [LabVIEW NXG]
inputs:
  "HW Parameters In": T4 = {"Active Antenna"="TX1", "Carrier Frequency (Hz)"=915000000, "Gain (dB)"=10, "Generation Mode"="Continuous", "Device IP Address"="192.168.10.3"}
  "Modulation Parameters In": T8 = {"Modulation Type"="QPSK", "Pulse Shaping Parameters"={"Modulation Type"="PSK", "Pulse Shaping Filter"="Raised Cosine", "Filter Parameter"=0.5, "Filter Length (Symbols)"=8}, "TX Oversample Factor"=20, "Packet Length (Bits)"=500, "TX Sample Rate"=100, "Control Information For Packet Header/Tail"={"Training Sequence "="Length 11 Barker Sequence", "Zero Pad Length"=8}}
  "Channel Model Parameters": T3 = {"Noise Power (dB)"=-Inf, "Channel Response"=[], "Frequency Offset"=0, "Delay (sec)"=0, "Channel Model"="AWGN"}
  "error in": error
  "Queues In": T1
outputs:
  "error out": error
  "HW Parameters Out": T4
  "Modulation Parameters Out": T8
  "Output Complex Waveform": cluster{"t0": f64, "dt": f64, "Y": c128[]}
  "Actual Delay (Sec)": f64
  "Data Symbols": c128[]
  "Number of Data Symbols": i32
  "Key Bit Sequence": i8[]
  "Queues Out": T1
  "Eye Diagram": cluster{"t0": f64, "dt": f64, "Y": f64[]}[]
  "Transmitted Constellation": T2[]
panel controls:
  "Tab": i32
types:
  T1 = cluster{"Key Bit Sequence Queue": Queue<u8[]>, "Training Sequence Queue": Queue<c128[]>}
  T2 = cluster{"constellation": f64[], "oversampled data": f64[]}
  T3 = cluster{"Noise Power (dB)": f64, "Channel Response": c128[], "Frequency Offset": f64, "Delay (sec)": f64, "Channel Model": string}
  T4 = cluster{"Active Antenna": string, "Carrier Frequency (Hz)": f64, "Gain (dB)": f64, "Generation Mode": enum{"Single Shot", "Simulate", "Continuous"}, "Device IP Address": string}
  T5 = enum{"none", "Raised Cosine", "Root Raised Cos", "Gaussian"}
  T6 = cluster{"Modulation Type": enum{"FSK", "PSK", "QAM", "MSK", "PAM", "ASK"}, "Pulse Shaping Filter": T5, "Filter Parameter": f64, "Filter Length (Symbols)": i32}
  T7 = cluster{"Training Sequence ": string, "Zero Pad Length": i32}
  T8 = cluster{"Modulation Type": string, "Pulse Shaping Parameters": T6, "TX Oversample Factor": i32, "Packet Length (Bits)": i32, "TX Sample Rate": f64, "Control Information For Packet Header/Tail": T7}
diagram:
  $"HW Parameters Out" <- $"HW Parameters In"
  case ($"error in") {
    frame No Error {
      # symbol rate
      # data symbols
      call "source.gvi"(Modulation Parameters In=$"Modulation Parameters In", error in (no error)=$"error in") -> (Modulation Parameters Out=w3, output bit stream=w4, error out=w5)
      call "modulate.gviprotected"(Modulation Parameters In=w3, input bit stream=w4, error in (no error)=w5) -> (Modulation Parameters Out=w6, output symbols=w7, error out=w8)
      call "add_control.gvi"(error in (no error)=w8, input=w7, Modulation Parameters In=w6) -> (error out=w9, output=w10, Modulation Parameters Out=w11, training symbols=w12)
      # 2. generate baseband signal from source bits
      # place generated key bit sequence
      # and training sequence in their queues
      call "transmitter_enque (SubVI).gvi"(key bit stream=w4, training symbols=w12, Queues In=$"Queues In", error in=w9) -> (Queues Out=w13, error out=w14)
      call "pulse_shaping.gviprotected"(Modulation Parameters In=w11, input=w10, error in (no error)=w14) -> (Modulation Parameters Out=w15, output=w16, error out=w17)
      Property Node(instance in=$"Modulation Parameters In") -> ("Pulse Shaping Parameters:Pulse Shaping Filter"=w18)
      # When the pulse shaping is a rectangle, add one element at the beginning
      # to have the same shift than with other filters (up to a multiple of the oversampling factor).
      # This enable to compare the maximum energy curves of the symbol timing block.
      case (w18) {
        frame "none" {
          Insert Into Array(inArray=w16, index0=0, new=0+0i) -> w19
        }
        frame "Raised Cosine", Default {
          w19 = w16
        }
      }
      # 3. Apply artificial channel to baseband signal
      call "transmitter_apply_channel (SubVI).gvi"(Channel Model Parameters=$"Channel Model Parameters", Input Waveform=w19, Modulation Parameters In=w15, error in=w17) -> (Modulation Parameters Out=w2, Output Complex Waveform=w20, Actual Delay (Sec)=w21, error out=w1)
      $"Output Complex Waveform" <- w20
      # 1. Get symbol rate and determine number of data symbols
      call "transmitter_init (SubVI).gvi"(Modulation Parameters In=$"Modulation Parameters In") -> (symbol rate=w22, number of data symbols=w23)
      # 1. Get symbol period and determine number of data symbols
      # 2. generate baseband signal from source bits
      # 3. Apply artificial channel to baseband signal
      # generate plots
      call "transmitter_generate_waveforms (SubVI).gvi"(complex waveform=w20, symbol rate (Hz)=w22, Y=w7) -> (transmitted constellation=w24, eye diagram=w25)
      $"Transmitted Constellation" <- w24
      $"Eye Diagram" <- w25
      $"Number of Data Symbols" <- w23
      $"Actual Delay (Sec)" <- w21
      $"Key Bit Sequence" <- w4
      $"Data Symbols" <- w7
      $"Queues Out" <- w13
    }
    frame Error {
      w1 = $"error in"
      w2 = $"Modulation Parameters In"
    }
  }
  $"Modulation Parameters Out" <- w2
  $"error out" <- w1
